# Grasshopper definition Building.1.gh (Grasshopper 0.9.76)

number_slider = Slider(5, range=0..10)  # disabled
number_slider_2 = Slider(1200, range=0..10000)  # disabled
number_slider_3 = Slider(5, range=0..10)
number_slider_4 = Slider(30, range=0..100)  # disabled
number_slider_5 = Slider(4000, range=0..10000)  # disabled
number_slider_6 = Slider(1200, range=0..10000)  # disabled
number_slider_7 = Slider(5, range=0..10)  # disabled
number_slider_8 = Slider(1000, range=0..1000)  # disabled
number_slider_9 = Slider(4000, range=0..10000)  # disabled
number_slider_10 = Slider(30, range=0..100)  # disabled
number_slider_11 = Slider(52998, range=0..100000)
c_script = CSharpScript(
    WindowWidth=number_slider_5,
    WindowHeight=number_slider_6,
    FrameSize=number_slider_4,
    FrameThickness=number_slider,
    GlassThickness=number_slider)  # -> Frame, Glass; inputs WindowWidth: Double, WindowHeight: Double, FrameSize: Double, FrameThickness: Double, GlassThickness: Double; disabled
# ---------- c_script: C# ----------
    Brep TempFrame,TempGlass;
    GetGlassSimple(WindowWidth, WindowHeight, FrameSize, FrameThickness, GlassThickness, out TempFrame, out TempGlass);
    Frame = TempFrame;
    Glass = TempGlass;
# ---------- c_script: C# additional code ----------
  public void GetGlassWithSpandrel(double WindowWidth, double WindowHeight, double FrameSize, double FrameThickness, double GlassThickness, double SpandrelHeight, out Brep[] Frame, out Brep Glass, out Brep Spandrel){
    double SpandrelSpace = FrameSize;
    double SpandrelSpaceZ = GlassThickness * 2;
    double SpandrelThickness = GlassThickness;

    GetGlassWithSpandrel(WindowWidth, WindowHeight, FrameSize, FrameThickness, GlassThickness, SpandrelHeight, SpandrelSpace, SpandrelSpaceZ, SpandrelThickness, out Frame, out Glass, out Spandrel);
  }

  public void GetGlassWithSpandrel(double WindowWidth, double WindowHeight, double FrameSize, double FrameThickness, double GlassThickness, double SpandrelHeight, double SpandrelSpace, double SpandrelSpaceZ, double SpandrelThickness, out Brep[] Frame, out Brep Glass, out Brep Spandrel){
    Brep BaseFrame;
    GetGlassSimple(WindowWidth, WindowHeight, FrameSize, FrameThickness, GlassThickness, out BaseFrame, out Glass);
    Spandrel = Brep.CreateFromBox(new Box(new Plane(new Point3d(0, 0, 0), new Vector3d(0, 1, 0)), new Interval(SpandrelSpace, WindowWidth - SpandrelSpace), new Interval(SpandrelSpace, WindowHeight - SpandrelSpace), new Interval(SpandrelSpaceZ, SpandrelSpaceZ + SpandrelThickness)));
    Brep SpandrelFrame = Brep.CreateFromBox(new Box(new Plane(new Point3d(0, 0, 0), new Vector3d(0, 1, 0)), new Interval(FrameSize / 2.0, WindowWidth - FrameSize / 2.0), new Interval(SpandrelHeight, SpandrelHeight + FrameSize), new Interval(-FrameThickness, GlassThickness)));
    Frame = new Brep[]{BaseFrame,SpandrelFrame};
  }


  public void GetGlassSimple(double WindowWidth, double WindowHeight, double FrameSize, double FrameThickness, double GlassThickness, out Brep Frame, out Brep Glass)
  {
    Brep FrameBase = Brep.CreateFromBox(new Box(new Plane(new Point3d(0, 0, 0), new Vector3d(0, 1, 0)), new Interval(0, WindowWidth), new Interval(0, WindowHeight), new Interval(-FrameThickness, GlassThickness)));
    Brep Splitter = Brep.CreateFromBox(new Box(new Plane(new Point3d(0, 0, 0), new Vector3d(0, 1, 0)), new Interval(FrameSize, WindowWidth - FrameSize), new Interval(FrameSize, WindowHeight - FrameSize), new Interval(-FrameThickness * 2, GlassThickness * 2)));
    var SplitResult = (FrameBase.Split(Splitter, 0.10));
    Frame = SplitResult[0];
    Glass = Brep.CreateFromBox(new Box(new Plane(new Point3d(0, 0, 0), new Vector3d(0, 1, 0)), new Interval(FrameSize, WindowWidth - FrameSize), new Interval(FrameSize, WindowHeight - FrameSize), new Interval(0, GlassThickness)));
  }
# ---------- end c_script ----------
c_script_2 = CSharpScript(
    WindowWidth=Slider(1200, range=0..10000),
    WindowHeight=Slider(4000, range=0..10000),
    FrameSize=Slider(30, range=0..100),
    SpandrelHeight=Slider(1000, range=0..1000),
    BuildingX=number_slider_11,
    BuildingY=number_slider_11,
    BuildingZ=number_slider_11)  # -> Frame, Glass, Spandrel, Wall, Floor, Loof, Ceiling; inputs WindowWidth: Double, WindowHeight: Double, FrameSize: Double, SpandrelHeight: Double, BuildingX: Double, BuildingY: Double, BuildingZ: Double
# ---------- c_script_2: C# ----------
    Brep[] FrameTemp;
    Brep[] GlassTemp;
    Brep[] SpandrelTemp;
    Brep[] WallTemp;
    Brep[] FloorTemp;
    Brep[] LoofTemp;
    Brep[] CeilingTemp;
    GetBuildingGlass(WindowWidth, WindowHeight, FrameSize, SpandrelHeight, BuildingX, BuildingY, BuildingZ, out FrameTemp, out GlassTemp, out SpandrelTemp, out WallTemp, out FloorTemp, out LoofTemp, out CeilingTemp, true);
    Frame = FrameTemp;
    Glass = GlassTemp;
    Spandrel = SpandrelTemp;
    Wall = WallTemp;
    Floor = FloorTemp;
    Loof = LoofTemp;
    Ceiling = CeilingTemp;
# ---------- c_script_2: C# additional code ----------
  public Brep[] RepeatBrep(Brep Origin, Vector3d Vector, int Count){
    return RepeatBrep(Origin, Vector, new Vector3d(0, 0, 0), Count, 1);
  }

  public Brep[] RepeatBrep(Brep Origin, Vector3d Vector1, Vector3d Vector2, int CountX, int CountY){
    return RepeatBrep(Origin, Vector1, Vector2, new Vector3d(0, 0, 0), CountX, CountY, 1);
  }

  public Brep[] RepeatBrep(Brep[] Origin, Vector3d Vector, int Count){
    return RepeatBrep(Origin, Vector, new Vector3d(0, 0, 0), Count, 1);
  }

  public Brep[] RepeatBrep(Brep[] Origin, Vector3d Vector1, Vector3d Vector2, int CountX, int CountY){
    return RepeatBrep(Origin, Vector1, Vector2, new Vector3d(0, 0, 0), CountX, CountY, 1);
  }

  public Brep[] RepeatBrep(Brep Origin, Vector3d Vector1, Vector3d Vector2, Vector3d Vector3, int CountX, int CountY, int CountZ){
    return RepeatBrep(new Brep[]{ Origin}, Vector1, Vector2, Vector3, CountX, CountY, CountZ);
  }

  public Brep[] RepeatBrep(Brep[] Origin, Vector3d Vector1, Vector3d Vector2, Vector3d Vector3, int CountX, int CountY, int CountZ){
    Brep[] Result = new Brep[CountX * CountY * CountZ * Origin.GetLength(0)];
    for(int i = 0;i < CountZ;i++){
      for(int j = 0;j < CountY;j++){
        for(int k = 0;k < CountX;k++){
          for(int l = 0;l < Origin.GetLength(0);l++){
            Brep tempBrep = (Brep) Origin[l].Duplicate();
            tempBrep.Translate(Vector1 * k + Vector2 * j + Vector3 * i);
            Result[i * CountX * CountY * Origin.GetLength(0) + j * CountX * Origin.GetLength(0) + k * Origin.GetLength(0) + l] = tempBrep;
          }
        }
      }
    }
    return Result;
  }

  public void Rotate(ref Brep[] target, double angleRadians, Vector3d rotationAxis, Point3d rotationCenter){
    foreach(Brep bp in target){
      bp.Rotate(angleRadians, rotationAxis, rotationCenter);
    }
  }

  public Brep[] Duplicate(Brep[] origin){
    Brep[] result = new Brep[origin.GetLength(0)];
    for(int i = 0;i < origin.GetLength(0);i++){
      result[i] = (Brep) origin[i].Duplicate();
    }
    return result;
  }

  public void GetBuildingGlass(double WindowWidth, double WindowHeight, double FrameSize, double SpandrelHeight, double BuildingX, double BuildingY, double BuildingZ, out Brep[] Frame, out Brep[] Glass, out Brep[] Spandrel, out Brep[] Wall, out Brep[] Floor, out Brep[] Loof, out Brep[] Ceiling, bool BothSide){
    Brep TempGlass,TempSpandrel;
    Brep[] TempFrame;
    int xcnt,ycnt;
    xcnt = (int) Math.Floor(BuildingX / WindowWidth);
    ycnt = (int) Math.Floor(BuildingZ / WindowHeight);
    double FrameThickness = FrameSize;
    double GlassThickness = 5.0;
    GetGlassWithSpandrelUpsidedown(WindowWidth, WindowHeight, FrameSize, FrameThickness, GlassThickness, SpandrelHeight, out TempFrame, out TempGlass, out TempSpandrel);

    Brep[] TempFrames = TempFrame;
    Brep[] TempGlasses;
    Brep[] TempSpandrels;
    if(BothSide){
      TempFrames = new Brep[TempFrame.GetLength(0) * 2];
      for(int i = 0;i < TempFrame.GetLength(0);i++){
        TempFrames[i] = TempFrame[i];
        TempFrames[i + TempFrame.GetLength(0)] = (Brep) TempFrame[i].Duplicate();
        TempFrames[i + TempFrame.GetLength(0)].Rotate(Math.PI, new Vector3d(0, 0, 1), new Point3d(WindowWidth / 2.0, 0, 0));
        TempFrames[i + TempFrame.GetLength(0)].Translate(0, BuildingY, 0);
      }
      TempGlasses = new Brep[2]{TempGlass,((Brep) TempGlass.Duplicate())};
      TempSpandrels = new Brep[2]{TempSpandrel,((Brep) TempSpandrel.Duplicate())};
      TempGlasses[1].Rotate(Math.PI, new Vector3d(0, 0, 1), new Point3d(WindowWidth / 2.0, 0, 0));
      TempSpandrels[1].Rotate(Math.PI, new Vector3d(0, 0, 1), new Point3d(WindowWidth / 2.0, 0, 0));
      TempGlasses[1].Translate(0, BuildingY, 0);
      TempSpandrels[1].Translate(0, BuildingY, 0);
    }else{
      TempFrames = TempFrame;
      TempGlasses = new Brep[1]{TempGlass};
      TempSpandrels = new Brep[1]{TempSpandrel};
    }

    Frame = RepeatBrep(TempFrames, new Vector3d(WindowWidth, 0, 0), new Vector3d(0, 0, WindowHeight), xcnt, ycnt);
    Glass = RepeatBrep(TempGlasses, new Vector3d(WindowWidth, 0, 0), new Vector3d(0, 0, WindowHeight), xcnt, ycnt);
    Spandrel = RepeatBrep(TempSpandrels, new Vector3d(WindowWidth, 0, 0), new Vector3d(0, 0, WindowHeight), xcnt, ycnt);

    Floor = new Brep[ycnt];
    for(int i = 0;i < ycnt;i++){
      Floor[i] = Brep.CreateFromBox(new Box(new Plane(new Point3d(0, 0, i * WindowHeight), new Vector3d(0, 0, 1)), new Interval(0, xcnt * WindowWidth), new Interval(15.0, BuildingY - 15.0), new Interval(-SpandrelHeight / 2.0, 0)));
    }
    Ceiling = new Brep[ycnt];
    for(int i = 1;i <= ycnt;i++){
      Ceiling[i - 1] = Brep.CreateFromBox(new Box(new Plane(new Point3d(0, 0, i * WindowHeight), new Vector3d(0, 0, 1)), new Interval(0, xcnt * WindowWidth), new Interval(15.0, BuildingY - 15.0), new Interval(-SpandrelHeight, -SpandrelHeight / 2.0)));
    }


    double WallThickness = 300;
    Wall = new Brep[]{
      Brep.CreateFromBox(new Box(new Plane(new Point3d(0, 0, 0), new Vector3d(0, 0, 1)), new Interval(-WallThickness, 0), new Interval(0, BuildingY), new Interval(0, ycnt * WindowHeight))),
      Brep.CreateFromBox(new Box(new Plane(new Point3d(xcnt * WindowWidth, 0, 0), new Vector3d(0, 0, 1)), new Interval(0, WallThickness), new Interval(0, BuildingY), new Interval(0, ycnt * WindowHeight)))
      };
    Loof = new Brep[]{Brep.CreateFromBox(new Box(new Plane(new Point3d(0, 0, ycnt * WindowHeight), new Vector3d(0, 0, 1)), new Interval(0, ycnt * WindowWidth), new Interval(15.0, BuildingY - 15.0), new Interval(-SpandrelHeight / 2.0, 0)))};
  }

  public void GetGlassWithSpandrel(double WindowWidth, double WindowHeight, double FrameSize, double FrameThickness, double GlassThickness, double SpandrelHeight, out Brep[] Frame, out Brep Glass, out Brep Spandrel){
    double SpandrelSpace = FrameSize;
    double SpandrelSpaceZ = GlassThickness * 2;
    double SpandrelThickness = GlassThickness;

    GetGlassWithSpandrel(WindowWidth, WindowHeight, FrameSize, FrameThickness, GlassThickness, SpandrelHeight, SpandrelSpace, SpandrelSpaceZ, SpandrelThickness, out Frame, out Glass, out Spandrel);
  }

  public void GetGlassWithSpandrel(double WindowWidth, double WindowHeight, double FrameSize, double FrameThickness, double GlassThickness, double SpandrelHeight, double SpandrelSpace, double SpandrelSpaceZ, double SpandrelThickness, out Brep[] Frame, out Brep Glass, out Brep Spandrel){
    Brep BaseFrame;
    GetGlassSimple(WindowWidth, WindowHeight, FrameSize, FrameThickness, GlassThickness, out BaseFrame, out Glass);
    Spandrel = Brep.CreateFromBox(new Box(new Plane(new Point3d(0, 0, 0), new Vector3d(0, 1, 0)), new Interval(SpandrelSpace, SpandrelHeight - SpandrelSpace), new Interval(SpandrelSpace, WindowWidth - SpandrelSpace), new Interval(SpandrelSpaceZ, SpandrelSpaceZ + SpandrelThickness)));
    Brep SpandrelFrame = Brep.CreateFromBox(new Box(new Plane(new Point3d(0, 0, 0), new Vector3d(0, 1, 0)), new Interval(SpandrelHeight - FrameSize, SpandrelHeight), new Interval(FrameSize / 2.0, WindowWidth - FrameSize / 2.0), new Interval(-FrameThickness, GlassThickness)));
    Frame = new Brep[]{BaseFrame,SpandrelFrame};
  }

  public void GetGlassWithSpandrelUpsidedown(double WindowWidth, double WindowHeight, double FrameSize, double FrameThickness, double GlassThickness, double SpandrelHeight, out Brep[] Frame, out Brep Glass, out Brep Spandrel){
    double SpandrelSpace = FrameSize;
    double SpandrelSpaceZ = GlassThickness * 2;
    double SpandrelThickness = GlassThickness;

    GetGlassWithSpandrelUpsidedown(WindowWidth, WindowHeight, FrameSize, FrameThickness, GlassThickness, SpandrelHeight, SpandrelSpace, SpandrelSpaceZ, SpandrelThickness, out Frame, out Glass, out Spandrel);
  }

  public void GetGlassWithSpandrelUpsidedown(double WindowWidth, double WindowHeight, double FrameSize, double FrameThickness, double GlassThickness, double SpandrelHeight, double SpandrelSpace, double SpandrelSpaceZ, double SpandrelThickness, out Brep[] Frame, out Brep Glass, out Brep Spandrel){
    Brep BaseFrame;
    GetGlassSimple(WindowWidth, WindowHeight, FrameSize, FrameThickness, GlassThickness, out BaseFrame, out Glass);
    Spandrel = Brep.CreateFromBox(new Box(new Plane(new Point3d(0, 0, WindowHeight - SpandrelHeight), new Vector3d(0, 1, 0)), new Interval(SpandrelSpace, SpandrelHeight - SpandrelSpace), new Interval(SpandrelSpace, WindowWidth - SpandrelSpace), new Interval(SpandrelSpaceZ, SpandrelSpaceZ + SpandrelThickness)));
    Brep SpandrelFrame = Brep.CreateFromBox(new Box(new Plane(new Point3d(0, 0, 0), new Vector3d(0, 1, 0)), new Interval(WindowHeight - SpandrelHeight, WindowHeight - SpandrelHeight + FrameSize), new Interval(FrameSize / 2.0, WindowWidth - FrameSize / 2.0), new Interval(-FrameThickness, GlassThickness)));
    Frame = new Brep[]{BaseFrame,SpandrelFrame};
  }

  public void GetGlassSimple(double WindowWidth, double WindowHeight, double FrameSize, double FrameThickness, double GlassThickness, out Brep Frame, out Brep Glass)
  {
    Brep FrameBase = Brep.CreateFromBox(new Box(new Plane(new Point3d(0, 0, 0), new Vector3d(0, 1, 0)), new Interval(0, WindowHeight), new Interval(0, WindowWidth), new Interval(-FrameThickness, GlassThickness)));
    Brep Splitter = Brep.CreateFromBox(new Box(new Plane(new Point3d(0, 0, 0), new Vector3d(0, 1, 0)), new Interval(FrameSize, WindowHeight - FrameSize), new Interval(FrameSize, WindowWidth - FrameSize), new Interval(-FrameThickness * 2, GlassThickness * 2)));
    var SplitResult = (FrameBase.Split(Splitter, 0.10));
    Frame = SplitResult[0];
    Glass = Brep.CreateFromBox(new Box(new Plane(new Point3d(0, 0, 0), new Vector3d(0, 1, 0)), new Interval(FrameSize, WindowHeight - FrameSize), new Interval(FrameSize, WindowWidth - FrameSize), new Interval(0, GlassThickness)));
  }
# ---------- end c_script_2 ----------
c_script_3 = CSharpScript(
    WindowWidth=number_slider_2,
    WindowHeight=number_slider_9,
    FrameSize=number_slider_10,
    FrameThickness=number_slider_7,
    GlassThickness=number_slider_7,
    SpandrelHeight=number_slider_8)  # -> Frame, Glass, Spandrel; inputs WindowWidth: Double, WindowHeight: Double, FrameSize: Double, FrameThickness: Double, GlassThickness: Double, SpandrelHeight: Double; disabled
# ---------- c_script_3: C# ----------
                                                /*
    Brep TempFrame,TempGlass;
    GetGlassSimple(WindowWidth, WindowHeight, FrameSize, FrameThickness, GlassThickness, out TempFrame, out TempGlass);
    Frame = TempFrame;
    Glass = TempGlass;
  */
    Brep TempGlass,TempSpandrel;
    Brep[] TempFrame;
    GetGlassWithSpandrel(WindowWidth, WindowHeight, FrameSize, FrameThickness, GlassThickness, SpandrelHeight, out TempFrame, out TempGlass, out TempSpandrel);
    Frame = RepeatBrep(TempFrame, new Vector3d(WindowWidth, 0, 0), new Vector3d(0, 0, WindowHeight), 10, 10);
    Glass = RepeatBrep(TempGlass, new Vector3d(WindowWidth, 0, 0), new Vector3d(0, 0, WindowHeight), 10, 10);
    Spandrel = RepeatBrep(TempSpandrel, new Vector3d(WindowWidth, 0, 0), new Vector3d(0, 0, WindowHeight), 10, 10);
# ---------- c_script_3: C# additional code ----------
  public Brep[] RepeatBrep(Brep Origin, Vector3d Vector, int Count){
    return RepeatBrep(Origin, Vector, new Vector3d(0, 0, 0), Count, 1);
  }

  public Brep[] RepeatBrep(Brep Origin, Vector3d Vector1, Vector3d Vector2, int CountX, int CountY){
    return RepeatBrep(Origin, Vector1, Vector2, new Vector3d(0, 0, 0), CountX, CountY, 1);
  }

  public Brep[] RepeatBrep(Brep[] Origin, Vector3d Vector, int Count){
    return RepeatBrep(Origin, Vector, new Vector3d(0, 0, 0), Count, 1);
  }

  public Brep[] RepeatBrep(Brep[] Origin, Vector3d Vector1, Vector3d Vector2, int CountX, int CountY){
    return RepeatBrep(Origin, Vector1, Vector2, new Vector3d(0, 0, 0), CountX, CountY, 1);
  }

  public Brep[] RepeatBrep(Brep Origin, Vector3d Vector1, Vector3d Vector2, Vector3d Vector3, int CountX, int CountY, int CountZ){
    return RepeatBrep(new Brep[]{ Origin}, Vector1, Vector2, Vector3, CountX, CountY, CountZ);
  }

  public Brep[] RepeatBrep(Brep[] Origin, Vector3d Vector1, Vector3d Vector2, Vector3d Vector3, int CountX, int CountY, int CountZ){
    Brep[] Result = new Brep[CountX * CountY * CountZ*Origin.GetLength(0)];
    for(int i = 0;i < CountZ;i++){
      for(int j = 0;j < CountY;j++){
        for(int k = 0;k < CountX;k++){
          for(int l = 0;l < Origin.GetLength(0);l++){
            Brep tempBrep = (Brep) Origin[l].Duplicate();
            tempBrep.Translate(Vector1 * k + Vector2 * j + Vector3 * i);
            Result[i * CountX * CountY * Origin.GetLength(0) + j * CountX * Origin.GetLength(0) + k * Origin.GetLength(0) + l] = tempBrep;
          }
        }
      }
    }
    return Result;
  }

  public void GetGlassWithSpandrel(double WindowWidth, double WindowHeight, double FrameSize, double FrameThickness, double GlassThickness, double SpandrelHeight, out Brep[] Frame, out Brep Glass, out Brep Spandrel){
    double SpandrelSpace = FrameSize;
    double SpandrelSpaceZ = GlassThickness * 2;
    double SpandrelThickness = GlassThickness;

    GetGlassWithSpandrel(WindowWidth, WindowHeight, FrameSize, FrameThickness, GlassThickness, SpandrelHeight, SpandrelSpace, SpandrelSpaceZ, SpandrelThickness, out Frame, out Glass, out Spandrel);
  }

  public void GetGlassWithSpandrel(double WindowWidth, double WindowHeight, double FrameSize, double FrameThickness, double GlassThickness, double SpandrelHeight, double SpandrelSpace, double SpandrelSpaceZ, double SpandrelThickness, out Brep[] Frame, out Brep Glass, out Brep Spandrel){
    Brep BaseFrame;
    GetGlassSimple(WindowWidth, WindowHeight, FrameSize, FrameThickness, GlassThickness, out BaseFrame, out Glass);
    Spandrel = Brep.CreateFromBox(new Box(new Plane(new Point3d(0, 0, 0), new Vector3d(0, 1, 0)), new Interval(SpandrelSpace, SpandrelHeight - SpandrelSpace), new Interval(SpandrelSpace, WindowWidth - SpandrelSpace), new Interval(SpandrelSpaceZ, SpandrelSpaceZ + SpandrelThickness)));
    Brep SpandrelFrame = Brep.CreateFromBox(new Box(new Plane(new Point3d(0, 0, 0), new Vector3d(0, 1, 0)), new Interval(SpandrelHeight - FrameSize, SpandrelHeight), new Interval(FrameSize / 2.0, WindowWidth - FrameSize / 2.0), new Interval(-FrameThickness, GlassThickness)));
    Frame = new Brep[]{BaseFrame,SpandrelFrame};
  }


  public void GetGlassSimple(double WindowWidth, double WindowHeight, double FrameSize, double FrameThickness, double GlassThickness, out Brep Frame, out Brep Glass)
  {
    Brep FrameBase = Brep.CreateFromBox(new Box(new Plane(new Point3d(0, 0, 0), new Vector3d(0, 1, 0)), new Interval(0, WindowHeight), new Interval(0, WindowWidth), new Interval(-FrameThickness, GlassThickness)));
    Brep Splitter = Brep.CreateFromBox(new Box(new Plane(new Point3d(0, 0, 0), new Vector3d(0, 1, 0)), new Interval(FrameSize, WindowHeight - FrameSize), new Interval(FrameSize, WindowWidth - FrameSize), new Interval(-FrameThickness * 2, GlassThickness * 2)));
    var SplitResult = (FrameBase.Split(Splitter, 0.10));
    Frame = SplitResult[0];
    Glass = Brep.CreateFromBox(new Box(new Plane(new Point3d(0, 0, 0), new Vector3d(0, 1, 0)), new Interval(FrameSize, WindowHeight - FrameSize), new Interval(FrameSize, WindowWidth - FrameSize), new Interval(0, GlassThickness)));
  }
# ---------- end c_script_3 ----------
brep = Brep(c_script.Frame)  # disabled
brep_2 = Brep(c_script.Glass)  # disabled
brep_3 = Brep(c_script_2.Frame)
brep_4 = Brep(c_script_2.Wall)
brep_5 = Brep(c_script_2.Spandrel)
brep_6 = Brep(c_script_2.Loof)
brep_7 = Brep(c_script_2.Glass)
brep_8 = Brep(c_script_2.Floor)
brep_9 = Brep(c_script_3.Frame)  # disabled
brep_10 = Brep(c_script_3.Glass)  # disabled
brep_11 = Brep(c_script_2.Ceiling)
brep_12 = Brep(c_script_3.Spandrel)  # disabled
