# Grasshopper definition Building.3.gh (Grasshopper 0.9.76)

number_slider = Slider(1200, range=0..10000)  # disabled
number_slider_2 = Slider(5, range=0..10)  # disabled
number_slider_3 = Slider(1200, range=0..10000)  # disabled
number_slider_4 = Slider(5, range=0..10)  # disabled
number_slider_5 = Slider(1000, range=0..1000)  # disabled
number_slider_6 = Slider(30, range=0..100)  # disabled
number_slider_7 = Slider(4000, range=0..10000)  # disabled
number_slider_8 = Slider(4000, range=0..10000)  # disabled
number_slider_9 = Slider(1200, range=0..10000)  # disabled
number_slider_10 = Slider(5, range=0..10)  # disabled
number_slider_11 = Slider(30, range=0..100)  # disabled
number_slider_12 = Slider(1000, range=0..1000)  # disabled
number_slider_13 = Slider(4000, range=0..10000)  # disabled
number_slider_14 = Slider(30, range=0..100)  # disabled
number_slider_15 = Slider(25000, range=0..100000)  # disabled
number_slider_16 = Slider(15000, range=0..100000)  # disabled
number_slider_17 = Slider(300, range=0..1000)  # disabled
number_slider_18 = Slider(500, range=0..1000)  # disabled
number_slider_19 = Slider(400, range=0..1000)  # disabled
number_slider_20 = Slider(2000, range=0..10000)  # disabled
number_slider_21 = Slider(300, range=0..1000)  # disabled
number_slider_22 = Slider(4000, range=0..10000)  # disabled
crv = Curve(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)
c_script = CSharpScript(
    WindowWidth=number_slider_8,
    WindowHeight=number_slider_9,
    FrameSize=number_slider_6,
    FrameThickness=number_slider_2,
    GlassThickness=number_slider_2)  # -> Frame, Glass; inputs WindowWidth: Double, WindowHeight: Double, FrameSize: Double, FrameThickness: Double, GlassThickness: Double; disabled
# ---------- c_script: C# ----------
    Brep TempFrame,TempGlass;
    GetGlassSimple(WindowWidth, WindowHeight, FrameSize, FrameThickness, GlassThickness, out TempFrame, out TempGlass);
    Frame = TempFrame;
    Glass = TempGlass;
# ---------- c_script: C# additional code ----------
  public void GetGlassWithSpandrel(double WindowWidth, double WindowHeight, double FrameSize, double FrameThickness, double GlassThickness, double SpandrelHeight, out Brep[] Frame, out Brep Glass, out Brep Spandrel){
    double SpandrelSpace = FrameSize;
    double SpandrelSpaceZ = GlassThickness * 2;
    double SpandrelThickness = GlassThickness;

    GetGlassWithSpandrel(WindowWidth, WindowHeight, FrameSize, FrameThickness, GlassThickness, SpandrelHeight, SpandrelSpace, SpandrelSpaceZ, SpandrelThickness, out Frame, out Glass, out Spandrel);
  }

  public void GetGlassWithSpandrel(double WindowWidth, double WindowHeight, double FrameSize, double FrameThickness, double GlassThickness, double SpandrelHeight, double SpandrelSpace, double SpandrelSpaceZ, double SpandrelThickness, out Brep[] Frame, out Brep Glass, out Brep Spandrel){
    Brep BaseFrame;
    GetGlassSimple(WindowWidth, WindowHeight, FrameSize, FrameThickness, GlassThickness, out BaseFrame, out Glass);
    Spandrel = Brep.CreateFromBox(new Box(new Plane(new Point3d(0, 0, 0), new Vector3d(0, 1, 0)), new Interval(SpandrelSpace, WindowWidth - SpandrelSpace), new Interval(SpandrelSpace, WindowHeight - SpandrelSpace), new Interval(SpandrelSpaceZ, SpandrelSpaceZ + SpandrelThickness)));
    Brep SpandrelFrame = Brep.CreateFromBox(new Box(new Plane(new Point3d(0, 0, 0), new Vector3d(0, 1, 0)), new Interval(FrameSize / 2.0, WindowWidth - FrameSize / 2.0), new Interval(SpandrelHeight, SpandrelHeight + FrameSize), new Interval(-FrameThickness, GlassThickness)));
    Frame = new Brep[]{BaseFrame,SpandrelFrame};
  }


  public void GetGlassSimple(double WindowWidth, double WindowHeight, double FrameSize, double FrameThickness, double GlassThickness, out Brep Frame, out Brep Glass)
  {
    Brep FrameBase = Brep.CreateFromBox(new Box(new Plane(new Point3d(0, 0, 0), new Vector3d(0, 1, 0)), new Interval(0, WindowWidth), new Interval(0, WindowHeight), new Interval(-FrameThickness, GlassThickness)));
    Brep Splitter = Brep.CreateFromBox(new Box(new Plane(new Point3d(0, 0, 0), new Vector3d(0, 1, 0)), new Interval(FrameSize, WindowWidth - FrameSize), new Interval(FrameSize, WindowHeight - FrameSize), new Interval(-FrameThickness * 2, GlassThickness * 2)));
    var SplitResult = (FrameBase.Split(Splitter, 0.10));
    Frame = SplitResult[0];
    Glass = Brep.CreateFromBox(new Box(new Plane(new Point3d(0, 0, 0), new Vector3d(0, 1, 0)), new Interval(FrameSize, WindowWidth - FrameSize), new Interval(FrameSize, WindowHeight - FrameSize), new Interval(0, GlassThickness)));
  }
# ---------- end c_script ----------
c_script_2 = CSharpScript(
    WindowWidth=number_slider_3,
    WindowHeight=number_slider_13,
    FrameSize=number_slider_14,
    FrameThickness=number_slider_10,
    GlassThickness=number_slider_10,
    SpandrelHeight=number_slider_12)  # -> Frame, Glass, Spandrel; inputs WindowWidth: Double, WindowHeight: Double, FrameSize: Double, FrameThickness: Double, GlassThickness: Double, SpandrelHeight: Double; disabled
# ---------- c_script_2: C# ----------
                                                /*
    Brep TempFrame,TempGlass;
    GetGlassSimple(WindowWidth, WindowHeight, FrameSize, FrameThickness, GlassThickness, out TempFrame, out TempGlass);
    Frame = TempFrame;
    Glass = TempGlass;
  */
    Brep TempGlass,TempSpandrel;
    Brep[] TempFrame;
    GetGlassWithSpandrel(WindowWidth, WindowHeight, FrameSize, FrameThickness, GlassThickness, SpandrelHeight, out TempFrame, out TempGlass, out TempSpandrel);
    Frame = RepeatBrep(TempFrame, new Vector3d(WindowWidth, 0, 0), new Vector3d(0, 0, WindowHeight), 10, 10);
    Glass = RepeatBrep(TempGlass, new Vector3d(WindowWidth, 0, 0), new Vector3d(0, 0, WindowHeight), 10, 10);
    Spandrel = RepeatBrep(TempSpandrel, new Vector3d(WindowWidth, 0, 0), new Vector3d(0, 0, WindowHeight), 10, 10);
# ---------- c_script_2: C# additional code ----------
  public Brep[] RepeatBrep(Brep Origin, Vector3d Vector, int Count){
    return RepeatBrep(Origin, Vector, new Vector3d(0, 0, 0), Count, 1);
  }

  public Brep[] RepeatBrep(Brep Origin, Vector3d Vector1, Vector3d Vector2, int CountX, int CountY){
    return RepeatBrep(Origin, Vector1, Vector2, new Vector3d(0, 0, 0), CountX, CountY, 1);
  }

  public Brep[] RepeatBrep(Brep[] Origin, Vector3d Vector, int Count){
    return RepeatBrep(Origin, Vector, new Vector3d(0, 0, 0), Count, 1);
  }

  public Brep[] RepeatBrep(Brep[] Origin, Vector3d Vector1, Vector3d Vector2, int CountX, int CountY){
    return RepeatBrep(Origin, Vector1, Vector2, new Vector3d(0, 0, 0), CountX, CountY, 1);
  }

  public Brep[] RepeatBrep(Brep Origin, Vector3d Vector1, Vector3d Vector2, Vector3d Vector3, int CountX, int CountY, int CountZ){
    return RepeatBrep(new Brep[]{ Origin}, Vector1, Vector2, Vector3, CountX, CountY, CountZ);
  }

  public Brep[] RepeatBrep(Brep[] Origin, Vector3d Vector1, Vector3d Vector2, Vector3d Vector3, int CountX, int CountY, int CountZ){
    Brep[] Result = new Brep[CountX * CountY * CountZ*Origin.GetLength(0)];
    for(int i = 0;i < CountZ;i++){
      for(int j = 0;j < CountY;j++){
        for(int k = 0;k < CountX;k++){
          for(int l = 0;l < Origin.GetLength(0);l++){
            Brep tempBrep = (Brep) Origin[l].Duplicate();
            tempBrep.Translate(Vector1 * k + Vector2 * j + Vector3 * i);
            Result[i * CountX * CountY * Origin.GetLength(0) + j * CountX * Origin.GetLength(0) + k * Origin.GetLength(0) + l] = tempBrep;
          }
        }
      }
    }
    return Result;
  }

  public void GetGlassWithSpandrel(double WindowWidth, double WindowHeight, double FrameSize, double FrameThickness, double GlassThickness, double SpandrelHeight, out Brep[] Frame, out Brep Glass, out Brep Spandrel){
    double SpandrelSpace = FrameSize;
    double SpandrelSpaceZ = GlassThickness * 2;
    double SpandrelThickness = GlassThickness;

    GetGlassWithSpandrel(WindowWidth, WindowHeight, FrameSize, FrameThickness, GlassThickness, SpandrelHeight, SpandrelSpace, SpandrelSpaceZ, SpandrelThickness, out Frame, out Glass, out Spandrel);
  }

  public void GetGlassWithSpandrel(double WindowWidth, double WindowHeight, double FrameSize, double FrameThickness, double GlassThickness, double SpandrelHeight, double SpandrelSpace, double SpandrelSpaceZ, double SpandrelThickness, out Brep[] Frame, out Brep Glass, out Brep Spandrel){
    Brep BaseFrame;
    GetGlassSimple(WindowWidth, WindowHeight, FrameSize, FrameThickness, GlassThickness, out BaseFrame, out Glass);
    Spandrel = Brep.CreateFromBox(new Box(new Plane(new Point3d(0, 0, 0), new Vector3d(0, 1, 0)), new Interval(SpandrelSpace, SpandrelHeight - SpandrelSpace), new Interval(SpandrelSpace, WindowWidth - SpandrelSpace), new Interval(SpandrelSpaceZ, SpandrelSpaceZ + SpandrelThickness)));
    Brep SpandrelFrame = Brep.CreateFromBox(new Box(new Plane(new Point3d(0, 0, 0), new Vector3d(0, 1, 0)), new Interval(SpandrelHeight - FrameSize, SpandrelHeight), new Interval(FrameSize / 2.0, WindowWidth - FrameSize / 2.0), new Interval(-FrameThickness, GlassThickness)));
    Frame = new Brep[]{BaseFrame,SpandrelFrame};
  }


  public void GetGlassSimple(double WindowWidth, double WindowHeight, double FrameSize, double FrameThickness, double GlassThickness, out Brep Frame, out Brep Glass)
  {
    Brep FrameBase = Brep.CreateFromBox(new Box(new Plane(new Point3d(0, 0, 0), new Vector3d(0, 1, 0)), new Interval(0, WindowHeight), new Interval(0, WindowWidth), new Interval(-FrameThickness, GlassThickness)));
    Brep Splitter = Brep.CreateFromBox(new Box(new Plane(new Point3d(0, 0, 0), new Vector3d(0, 1, 0)), new Interval(FrameSize, WindowHeight - FrameSize), new Interval(FrameSize, WindowWidth - FrameSize), new Interval(-FrameThickness * 2, GlassThickness * 2)));
    var SplitResult = (FrameBase.Split(Splitter, 0.10));
    Frame = SplitResult[0];
    Glass = Brep.CreateFromBox(new Box(new Plane(new Point3d(0, 0, 0), new Vector3d(0, 1, 0)), new Interval(FrameSize, WindowHeight - FrameSize), new Interval(FrameSize, WindowWidth - FrameSize), new Interval(0, GlassThickness)));
  }
# ---------- end c_script_2 ----------
c_script_3 = CSharpScript(
    WindowWidth=number_slider,
    WindowHeight=number_slider_7,
    FrameSize=number_slider_11,
    SpandrelHeight=number_slider_5,
    BuildingX=number_slider_15,
    BuildingY=number_slider_16,
    BuildingZ=number_slider_15)  # -> Frame, Glass, Spandrel, Wall, Floor, Loof, Ceiling; inputs WindowWidth: Double, WindowHeight: Double, FrameSize: Double, SpandrelHeight: Double, BuildingX: Double, BuildingY: Double, BuildingZ: Double; disabled
# ---------- c_script_3: C# ----------
    Brep[] FrameTemp;
    Brep[] GlassTemp;
    Brep[] SpandrelTemp;
    Brep[] WallTemp;
    Brep[] FloorTemp;
    Brep[] LoofTemp;
    Brep[] CeilingTemp;
    try{
      GetBuildingGlass(WindowWidth, WindowHeight, FrameSize, SpandrelHeight, BuildingX, BuildingY, BuildingZ, out FrameTemp, out GlassTemp, out SpandrelTemp, out WallTemp, out FloorTemp, out LoofTemp, out CeilingTemp, true);
      //GetBuildingGlassFull(WindowWidth, WindowHeight, FrameSize, SpandrelHeight, BuildingX, BuildingY, BuildingZ, out FrameTemp, out GlassTemp, out SpandrelTemp, out FloorTemp, out LoofTemp, out CeilingTemp);
      Frame = FrameTemp;
      Glass = GlassTemp;
      Spandrel = SpandrelTemp;
      Wall = WallTemp;
      Floor = FloorTemp;
      Loof = LoofTemp;
      Ceiling = CeilingTemp;
    }catch(Exception e){
      Print(e.Message);
    }
# ---------- c_script_3: C# additional code ----------
  public Brep[] RepeatBrep(Brep Origin, Vector3d Vector, int Count){
    return RepeatBrep(Origin, Vector, new Vector3d(0, 0, 0), Count, 1);
  }

  public Brep[] RepeatBrep(Brep Origin, Vector3d Vector1, Vector3d Vector2, int CountX, int CountY){
    return RepeatBrep(Origin, Vector1, Vector2, new Vector3d(0, 0, 0), CountX, CountY, 1);
  }

  public Brep[] RepeatBrep(Brep[] Origin, Vector3d Vector, int Count){
    return RepeatBrep(Origin, Vector, new Vector3d(0, 0, 0), Count, 1);
  }

  public Brep[] RepeatBrep(Brep[] Origin, Vector3d Vector1, Vector3d Vector2, int CountX, int CountY){
    return RepeatBrep(Origin, Vector1, Vector2, new Vector3d(0, 0, 0), CountX, CountY, 1);
  }

  public Brep[] RepeatBrep(Brep Origin, Vector3d Vector1, Vector3d Vector2, Vector3d Vector3, int CountX, int CountY, int CountZ){
    return RepeatBrep(new Brep[]{ Origin}, Vector1, Vector2, Vector3, CountX, CountY, CountZ);
  }

  public Brep[] RepeatBrep(Brep[] Origin, Vector3d Vector1, Vector3d Vector2, Vector3d Vector3, int CountX, int CountY, int CountZ){
    Brep[] Result = new Brep[CountX * CountY * CountZ * Origin.GetLength(0)];
    for(int i = 0;i < CountZ;i++){
      for(int j = 0;j < CountY;j++){
        for(int k = 0;k < CountX;k++){
          for(int l = 0;l < Origin.GetLength(0);l++){
            Brep tempBrep = (Brep) Origin[l].Duplicate();
            tempBrep.Translate(Vector1 * k + Vector2 * j + Vector3 * i);
            Result[i * CountX * CountY * Origin.GetLength(0) + j * CountX * Origin.GetLength(0) + k * Origin.GetLength(0) + l] = tempBrep;
          }
        }
      }
    }
    return Result;
  }

  public void Rotate(ref Brep[] target, double angleRadians, Vector3d rotationAxis, Point3d rotationCenter){
    foreach(Brep bp in target){
      bp.Rotate(angleRadians, rotationAxis, rotationCenter);
    }
  }

  public Brep[] Duplicate(Brep[] origin){
    Brep[] result = new Brep[origin.GetLength(0)];
    for(int i = 0;i < origin.GetLength(0);i++){
      result[i] = (Brep) origin[i].Duplicate();
    }
    return result;
  }

  public void GetBuildingGlassFull(double WindowWidth, double WindowHeight, double FrameSize, double SpandrelHeight, double BuildingXTarget, double BuildingYTarget, double BuildingZTarget, out Brep[] Frame, out Brep[] Glass, out Brep[] Spandrel, out Brep[] Floor, out Brep[] Loof, out Brep[] Ceiling){
    GetBuildingGlassFull(WindowWidth, WindowWidth, WindowHeight, FrameSize, FrameSize, SpandrelHeight, SpandrelHeight, BuildingXTarget, BuildingYTarget, BuildingZTarget, out Frame, out Glass, out Spandrel, out Floor, out Loof, out  Ceiling);
  }

  public void GetBuildingGlassFull(double WindowWidth1, double WindowWidth2, double WindowHeight, double FrameSize1, double FrameSize2, double SpandrelHeight1, double SpandrelHeight2, double BuildingXTarget, double BuildingYTarget, double BuildingZTarget, out Brep[] Frame, out Brep[] Glass, out Brep[] Spandrel, out Brep[] Floor, out Brep[] Loof, out Brep[] Ceiling){
    Brep TempGlass1,TempSpandrel1,TempGlass2,TempSpandrel2;
    Brep[] TempFrame1,TempFrame2;
    int xcnt1,xcnt2,ycnt;
    xcnt1 = (int) Math.Floor(BuildingXTarget / WindowWidth1);
    double BuildingX = xcnt1 * WindowWidth1;
    xcnt2 = (int) Math.Floor(BuildingYTarget / WindowWidth2);
    double BuildingY = xcnt2 * WindowWidth2;
    ycnt = (int) Math.Floor(BuildingZTarget / WindowHeight);
    double BuildingZ = ycnt * WindowHeight;
    double FrameThickness1 = FrameSize1;
    double FrameThickness2 = FrameSize2;
    double GlassThickness = 5.0;
    GetGlassWithSpandrelUpsidedown(WindowWidth1, WindowHeight, FrameSize1, FrameThickness1, GlassThickness, SpandrelHeight1, out TempFrame1, out TempGlass1, out TempSpandrel1);
    GetGlassWithSpandrelUpsidedown(WindowWidth2, WindowHeight, FrameSize2, FrameThickness2, GlassThickness, SpandrelHeight2, out TempFrame2, out TempGlass2, out TempSpandrel2);

    Brep[] TempFrames1 = new Brep[TempFrame1.GetLength(0) * 2];
    Brep[] TempGlasses1;
    Brep[] TempSpandrels1;
    for(int i = 0;i < TempFrame1.GetLength(0);i++){
      TempFrames1[i] = TempFrame1[i];
      TempFrames1[i + TempFrame1.GetLength(0)] = (Brep) TempFrame1[i].Duplicate();
      TempFrames1[i + TempFrame1.GetLength(0)].Rotate(Math.PI, new Vector3d(0, 0, 1), new Point3d(WindowWidth1 / 2.0, 0, 0));
      TempFrames1[i + TempFrame1.GetLength(0)].Translate(0, BuildingY, 0);
    }
    TempGlasses1 = new Brep[2]{TempGlass1,((Brep) TempGlass1.Duplicate())};
    TempSpandrels1 = new Brep[2]{TempSpandrel1,((Brep) TempSpandrel1.Duplicate())};
    TempGlasses1[1].Rotate(Math.PI, new Vector3d(0, 0, 1), new Point3d(WindowWidth1 / 2.0, 0, 0));
    TempSpandrels1[1].Rotate(Math.PI, new Vector3d(0, 0, 1), new Point3d(WindowWidth1 / 2.0, 0, 0));
    TempGlasses1[1].Translate(0, BuildingY, 0);
    TempSpandrels1[1].Translate(0, BuildingY, 0);

    Brep[] TempFrames2 = new Brep[TempFrame2.GetLength(0) * 2];
    Brep[] TempGlasses2;
    Brep[] TempSpandrels2;
    for(int i = 0;i < TempFrame2.GetLength(0);i++){
      TempFrames2[i] = TempFrame2[i];
      TempFrames2[i + TempFrame2.GetLength(0)] = (Brep) TempFrame2[i].Duplicate();
      TempFrames2[i + TempFrame2.GetLength(0)].Rotate(Math.PI, new Vector3d(0, 0, 1), new Point3d(WindowWidth2 / 2.0, 0, 0));

      TempFrames2[i].Rotate(-Math.PI / 2.0, new Vector3d(0, 0, 1), new Point3d(BuildingY / 2.0, BuildingY / 2.0, 0));
      TempFrames2[i + TempFrame2.GetLength(0)].Rotate(-Math.PI / 2.0, new Vector3d(0, 0, 1), new Point3d(BuildingY / 2.0, BuildingY / 2.0, 0));

      TempFrames2[i + TempFrame2.GetLength(0)].Translate(BuildingX, 0, 0);
    }
    TempGlasses2 = new Brep[2]{TempGlass2,((Brep) TempGlass2.Duplicate())};
    TempSpandrels2 = new Brep[2]{TempSpandrel2,((Brep) TempSpandrel2.Duplicate())};
    TempGlasses2[1].Rotate(Math.PI, new Vector3d(0, 0, 1), new Point3d(WindowWidth2 / 2.0, 0, 0));
    TempSpandrels2[1].Rotate(Math.PI, new Vector3d(0, 0, 1), new Point3d(WindowWidth2 / 2.0, 0, 0));

    TempGlasses2[0].Rotate(-Math.PI / 2.0, new Vector3d(0, 0, 1), new Point3d(BuildingY / 2.0, BuildingY / 2.0, 0));
    TempGlasses2[1].Rotate(-Math.PI / 2.0, new Vector3d(0, 0, 1), new Point3d(BuildingY / 2.0, BuildingY / 2.0, 0));
    TempSpandrels2[0].Rotate(-Math.PI / 2.0, new Vector3d(0, 0, 1), new Point3d(BuildingY / 2.0, BuildingY / 2.0, 0));
    TempSpandrels2[1].Rotate(-Math.PI / 2.0, new Vector3d(0, 0, 1), new Point3d(BuildingY / 2.0, BuildingY / 2.0, 0));

    TempGlasses2[1].Translate(BuildingX, 0, 0);
    TempSpandrels2[1].Translate(BuildingX, 0, 0);

    Brep[] Frame1 = RepeatBrep(TempFrames1, new Vector3d(WindowWidth1, 0, 0), new Vector3d(0, 0, WindowHeight), xcnt1, ycnt);
    Brep[] Glass1 = RepeatBrep(TempGlasses1, new Vector3d(WindowWidth1, 0, 0), new Vector3d(0, 0, WindowHeight), xcnt1, ycnt);
    Brep[] Spandrel1 = RepeatBrep(TempSpandrels1, new Vector3d(WindowWidth1, 0, 0), new Vector3d(0, 0, WindowHeight), xcnt1, ycnt);

    Brep[] Frame2 = RepeatBrep(TempFrames2, new Vector3d(0, -WindowWidth2, 0), new Vector3d(0, 0, WindowHeight), xcnt2, ycnt);
    Brep[] Glass2 = RepeatBrep(TempGlasses2, new Vector3d(0, -WindowWidth2, 0), new Vector3d(0, 0, WindowHeight), xcnt2, ycnt);
    Brep[] Spandrel2 = RepeatBrep(TempSpandrels2, new Vector3d(0, -WindowWidth2, 0), new Vector3d(0, 0, WindowHeight), xcnt2, ycnt);

    Frame = new Brep[Frame1.GetLength(0) + Frame1.GetLength(0)];
    Glass = new Brep[Glass1.GetLength(0) + Glass2.GetLength(0)];
    Spandrel = new Brep[Spandrel1.GetLength(0) + Spandrel2.GetLength(0)];

    for(int i = 0;i < Frame1.GetLength(0);i++){
      Frame[i] = Frame1[i];
    }
    for(int i = 0;i < Frame2.GetLength(0);i++){
      Frame[Frame1.GetLength(0) + i] = Frame2[i];
    }
    for(int i = 0;i < Glass1.GetLength(0);i++){
      Glass[i] = Glass1[i];
    }
    for(int i = 0;i < Glass2.GetLength(0);i++){
      Glass[Glass1.GetLength(0) + i] = Glass2[i];
    }
    for(int i = 0;i < Spandrel1.GetLength(0);i++){
      Spandrel[i] = Spandrel1[i];
    }
    for(int i = 0;i < Spandrel2.GetLength(0);i++){
      Spandrel[Spandrel1.GetLength(0) + i] = Spandrel2[i];
    }

    Floor = new Brep[ycnt];
    double SpandrelHeight = Math.Min(SpandrelHeight1, SpandrelHeight2);
    for(int i = 0;i < ycnt;i++){
      Floor[i] = Brep.CreateFromBox(new Box(new Plane(new Point3d(0, 0, i * WindowHeight), new Vector3d(0, 0, 1)), new Interval(15.0, BuildingX - 15.0), new Interval(15.0, BuildingY - 15.0), new Interval(-SpandrelHeight / 2.0, 0)));
    }
    Ceiling = new Brep[ycnt];
    for(int i = 1;i <= ycnt;i++){
      Ceiling[i - 1] = Brep.CreateFromBox(new Box(new Plane(new Point3d(0, 0, i * WindowHeight), new Vector3d(0, 0, 1)), new Interval(15.0, BuildingX - 15.0), new Interval(15.0, BuildingY - 15.0), new Interval(-SpandrelHeight, -SpandrelHeight / 2.0)));
    }
    Loof = new Brep[]{Brep.CreateFromBox(new Box(new Plane(new Point3d(0, 0, ycnt * WindowHeight), new Vector3d(0, 0, 1)), new Interval(15.0, BuildingX - 15.0), new Interval(15.0, BuildingY - 15.0), new Interval(-SpandrelHeight / 2.0, 0)))};
  }

  public void GetBuildingGlass(double WindowWidth, double WindowHeight, double FrameSize, double SpandrelHeight, double BuildingX, double BuildingY, double BuildingZ, out Brep[] Frame, out Brep[] Glass, out Brep[] Spandrel, out Brep[] Wall, out Brep[] Floor, out Brep[] Loof, out Brep[] Ceiling, bool BothSide){
    Brep TempGlass,TempSpandrel;
    Brep[] TempFrame;
    int xcnt,ycnt;
    xcnt = (int) Math.Floor(BuildingX / WindowWidth);
    ycnt = (int) Math.Floor(BuildingZ / WindowHeight);
    double FrameThickness = FrameSize;
    double GlassThickness = 5.0;
    GetGlassWithSpandrelUpsidedown(WindowWidth, WindowHeight, FrameSize, FrameThickness, GlassThickness, SpandrelHeight, out TempFrame, out TempGlass, out TempSpandrel);

    Brep[] TempFrames = TempFrame;
    Brep[] TempGlasses;
    Brep[] TempSpandrels;
    if(BothSide){
      TempFrames = new Brep[TempFrame.GetLength(0) * 2];
      for(int i = 0;i < TempFrame.GetLength(0);i++){
        TempFrames[i] = TempFrame[i];
        TempFrames[i + TempFrame.GetLength(0)] = (Brep) TempFrame[i].Duplicate();
        TempFrames[i + TempFrame.GetLength(0)].Rotate(Math.PI, new Vector3d(0, 0, 1), new Point3d(WindowWidth / 2.0, 0, 0));
        TempFrames[i + TempFrame.GetLength(0)].Translate(0, BuildingY, 0);
      }
      TempGlasses = new Brep[2]{TempGlass,((Brep) TempGlass.Duplicate())};
      TempSpandrels = new Brep[2]{TempSpandrel,((Brep) TempSpandrel.Duplicate())};
      TempGlasses[1].Rotate(Math.PI, new Vector3d(0, 0, 1), new Point3d(WindowWidth / 2.0, 0, 0));
      TempSpandrels[1].Rotate(Math.PI, new Vector3d(0, 0, 1), new Point3d(WindowWidth / 2.0, 0, 0));
      TempGlasses[1].Translate(0, BuildingY, 0);
      TempSpandrels[1].Translate(0, BuildingY, 0);
    }else{
      TempFrames = TempFrame;
      TempGlasses = new Brep[1]{TempGlass};
      TempSpandrels = new Brep[1]{TempSpandrel};
    }

    Frame = RepeatBrep(TempFrames, new Vector3d(WindowWidth, 0, 0), new Vector3d(0, 0, WindowHeight), xcnt, ycnt);
    Glass = RepeatBrep(TempGlasses, new Vector3d(WindowWidth, 0, 0), new Vector3d(0, 0, WindowHeight), xcnt, ycnt);
    Spandrel = RepeatBrep(TempSpandrels, new Vector3d(WindowWidth, 0, 0), new Vector3d(0, 0, WindowHeight), xcnt, ycnt);

    Floor = new Brep[ycnt];
    for(int i = 0;i < ycnt;i++){
      Floor[i] = Brep.CreateFromBox(new Box(new Plane(new Point3d(0, 0, i * WindowHeight), new Vector3d(0, 0, 1)), new Interval(0, xcnt * WindowWidth), new Interval(15.0, BuildingY - 15.0), new Interval(-SpandrelHeight / 2.0, 0)));
    }
    Ceiling = new Brep[ycnt];
    for(int i = 1;i <= ycnt;i++){
      Ceiling[i - 1] = Brep.CreateFromBox(new Box(new Plane(new Point3d(0, 0, i * WindowHeight), new Vector3d(0, 0, 1)), new Interval(0, xcnt * WindowWidth), new Interval(15.0, BuildingY - 15.0), new Interval(-SpandrelHeight, -SpandrelHeight / 2.0)));
    }
    Loof = new Brep[]{Brep.CreateFromBox(new Box(new Plane(new Point3d(0, 0, ycnt * WindowHeight), new Vector3d(0, 0, 1)), new Interval(0, xcnt * WindowWidth), new Interval(15.0, BuildingY - 15.0), new Interval(-SpandrelHeight / 2.0, 0)))};

    double WallThickness = 300;
    Wall = new Brep[]{
      Brep.CreateFromBox(new Box(new Plane(new Point3d(0, 0, 0), new Vector3d(0, 0, 1)), new Interval(-WallThickness, 0), new Interval(0, BuildingY), new Interval(0, ycnt * WindowHeight))),
      Brep.CreateFromBox(new Box(new Plane(new Point3d(xcnt * WindowWidth, 0, 0), new Vector3d(0, 0, 1)), new Interval(0, WallThickness), new Interval(0, BuildingY), new Interval(0, ycnt * WindowHeight)))
      };
  }

  public void GetGlassWithSpandrel(double WindowWidth, double WindowHeight, double FrameSize, double FrameThickness, double GlassThickness, double SpandrelHeight, out Brep[] Frame, out Brep Glass, out Brep Spandrel){
    double SpandrelSpace = FrameSize;
    double SpandrelSpaceZ = GlassThickness * 2;
    double SpandrelThickness = GlassThickness;

    GetGlassWithSpandrel(WindowWidth, WindowHeight, FrameSize, FrameThickness, GlassThickness, SpandrelHeight, SpandrelSpace, SpandrelSpaceZ, SpandrelThickness, out Frame, out Glass, out Spandrel);
  }

  public void GetGlassWithSpandrel(double WindowWidth, double WindowHeight, double FrameSize, double FrameThickness, double GlassThickness, double SpandrelHeight, double SpandrelSpace, double SpandrelSpaceZ, double SpandrelThickness, out Brep[] Frame, out Brep Glass, out Brep Spandrel){
    Brep BaseFrame;
    GetGlassSimple(WindowWidth, WindowHeight, FrameSize, FrameThickness, GlassThickness, out BaseFrame, out Glass);
    Spandrel = Brep.CreateFromBox(new Box(new Plane(new Point3d(0, 0, 0), new Vector3d(0, 1, 0)), new Interval(SpandrelSpace, SpandrelHeight - SpandrelSpace), new Interval(SpandrelSpace, WindowWidth - SpandrelSpace), new Interval(SpandrelSpaceZ, SpandrelSpaceZ + SpandrelThickness)));
    Brep SpandrelFrame = Brep.CreateFromBox(new Box(new Plane(new Point3d(0, 0, 0), new Vector3d(0, 1, 0)), new Interval(SpandrelHeight - FrameSize, SpandrelHeight), new Interval(FrameSize / 2.0, WindowWidth - FrameSize / 2.0), new Interval(-FrameThickness, GlassThickness)));
    Frame = new Brep[]{BaseFrame,SpandrelFrame};
  }

  public void GetGlassWithSpandrelUpsidedown(double WindowWidth, double WindowHeight, double FrameSize, double FrameThickness, double GlassThickness, double SpandrelHeight, out Brep[] Frame, out Brep Glass, out Brep Spandrel){
    double SpandrelSpace = FrameSize;
    double SpandrelSpaceZ = GlassThickness * 2;
    double SpandrelThickness = GlassThickness;

    GetGlassWithSpandrelUpsidedown(WindowWidth, WindowHeight, FrameSize, FrameThickness, GlassThickness, SpandrelHeight, SpandrelSpace, SpandrelSpaceZ, SpandrelThickness, out Frame, out Glass, out Spandrel);
  }

  public void GetGlassWithSpandrelUpsidedown(double WindowWidth, double WindowHeight, double FrameSize, double FrameThickness, double GlassThickness, double SpandrelHeight, double SpandrelSpace, double SpandrelSpaceZ, double SpandrelThickness, out Brep[] Frame, out Brep Glass, out Brep Spandrel){
    Brep BaseFrame;
    GetGlassSimple(WindowWidth, WindowHeight, FrameSize, FrameThickness, GlassThickness, out BaseFrame, out Glass);
    Spandrel = Brep.CreateFromBox(new Box(new Plane(new Point3d(0, 0, WindowHeight - SpandrelHeight), new Vector3d(0, 1, 0)), new Interval(SpandrelSpace, SpandrelHeight - SpandrelSpace), new Interval(SpandrelSpace, WindowWidth - SpandrelSpace), new Interval(SpandrelSpaceZ, SpandrelSpaceZ + SpandrelThickness)));
    Brep SpandrelFrame = Brep.CreateFromBox(new Box(new Plane(new Point3d(0, 0, 0), new Vector3d(0, 1, 0)), new Interval(WindowHeight - SpandrelHeight, WindowHeight - SpandrelHeight + FrameSize), new Interval(FrameSize / 2.0, WindowWidth - FrameSize / 2.0), new Interval(-FrameThickness, GlassThickness)));
    Frame = new Brep[]{BaseFrame,SpandrelFrame};
  }

  public void GetGlassSimple(double WindowWidth, double WindowHeight, double FrameSize, double FrameThickness, double GlassThickness, out Brep Frame, out Brep Glass)
  {
   GetGlassSimple(WindowWidth, WindowHeight, FrameSize, FrameSize, FrameThickness, GlassThickness, out Frame, out Glass);
  }

  public void GetGlassSimple(double WindowWidth, double WindowHeight, double FrameSizeX, double FrameSizeY, double FrameThickness, double GlassThickness, out Brep Frame, out Brep Glass)
  {
    Brep FrameBase = Brep.CreateFromBox(new Box(new Plane(new Point3d(0, 0, 0), new Vector3d(0, 1, 0)), new Interval(0, WindowHeight), new Interval(0, WindowWidth), new Interval(-FrameThickness, GlassThickness)));
    Brep Splitter = Brep.CreateFromBox(new Box(new Plane(new Point3d(0, 0, 0), new Vector3d(0, 1, 0)), new Interval(FrameSizeY, WindowHeight - FrameSizeY), new Interval(FrameSizeX, WindowWidth - FrameSizeX), new Interval(-FrameThickness * 2, GlassThickness * 2)));
    var SplitResult = (FrameBase.Split(Splitter, 0.10));
    Frame = SplitResult[0];
    Glass = Brep.CreateFromBox(new Box(new Plane(new Point3d(0, 0, 0), new Vector3d(0, 1, 0)), new Interval(FrameSizeY, WindowHeight - FrameSizeY), new Interval(FrameSizeX, WindowWidth - FrameSizeX), new Interval(0, GlassThickness)));
  }
# ---------- end c_script_3 ----------
crv_2 = Curve(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)  # disabled
crv_3 = Curve(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)  # disabled
crv_4 = Curve(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)  # disabled
crv_5 = Curve([<curve referenced from the Rhino model> x2])  # disabled
c_script_4 = CSharpScript(x=crv_3, y=crv_2)  # -> A; inputs x: Curve, y: Curve; disabled
# ---------- c_script_4: C# ----------
    Curve mean = Curve.CreateMeanCurve(x, y);

    Curve[] cvs = GetDashedLine(mean, 5000.0);
    for(int i = 0;i < cvs.GetLength(0)  ;i++){
      cvs[i] = GetCurveWithWidth(cvs[i], 300.0);
    }
    A = cvs;
# ---------- c_script_4: C# additional code ----------
  public Curve GetCurveWithWidth(Curve Origin, double Width){
    Width /= 2;
    Curve cv1 = (Origin.Offset(Plane.WorldXY, Width, Width / 100.0, Rhino.Geometry.CurveOffsetCornerStyle.Sharp))[0];
    Curve cv2 = (Origin.Offset(Plane.WorldXY, -Width, Width / 100.0, Rhino.Geometry.CurveOffsetCornerStyle.Sharp))[0];

    return (Curve.JoinCurves(new Curve[]{cv1,cv2,NurbsCurve.CreateFromLine(new Line(cv1.PointAtEnd, cv2.PointAtEnd)),NurbsCurve.CreateFromLine(new Line(cv1.PointAtStart, cv2.PointAtStart))}))[0];
  }

  public Curve[] GetDashedLine(Curve Origin, double SegmentLength){
    int Count = (int) Math.Floor(Origin.GetLength() / SegmentLength / 2.0);
    Curve[] result = new Curve[Count + 1];

    for(int i = 0;i <= Count ;i++){
      Curve TempCurve = (Curve) Origin.Duplicate();
      Point3d a = TempCurve.PointAtLength(i * SegmentLength * 2.0);
      Point3d b = TempCurve.PointAtLength(i * SegmentLength * 2.0 + SegmentLength);
      double at,bt;
      TempCurve.ClosestPoint(a, out at);
      TempCurve.ClosestPoint(b, out bt);
      TempCurve = (TempCurve.Split(new double[]{at,bt}))[i == 0 ? 0 : 1];
      result[i] = TempCurve;
    }
    return result;
  }
# ---------- end c_script_4 ----------
c_script_5 = CSharpScript(
    FrameSizeX=number_slider_21,
    FrameSizeY=number_slider_19,
    FrameThickness1=number_slider_17,
    FrameThickness2=number_slider_18,
    UnitSizeX=number_slider_20,
    UnitSizeY=number_slider_22)  # -> A, B, C; inputs FrameSizeX: Double, FrameSizeY: Double, FrameThickness1: Double, FrameThickness2: Double, UnitSizeX: Double, UnitSizeY: Double; disabled
# ---------- c_script_5: C# ----------
    Brep[] TempGlass;
    Brep[] TempFrame1;
    Brep[] TempFrame2;
    GetIsolatedWindow(FrameSizeX, FrameSizeY, FrameThickness1, FrameThickness2, UnitSizeX, UnitSizeY, 5.0, 10, 15, out TempGlass, out TempFrame1, out TempFrame2);
    A = TempGlass;
    B = TempFrame1;
    C = TempFrame2;
# ---------- c_script_5: C# additional code ----------
  public void GetIsolatedWindow(double FrameSizeX, double FrameSizeY, double FrameThickness1, double FrameThickness2, double UnitSizeX, double UnitSizeY, double GlassThickness, int UnitCountX, int UnitCountY, out Brep[] Glass, out Brep[] Frame1, out Brep[] Frame2){
    Frame1 = new Brep[UnitCountY * 2];
    for(int i = 0;i < UnitCountY;i++){
      Frame1[i * 2] = Brep.CreateFromBox(new Box(new Plane(new Point3d(0, 0, UnitSizeY * i), new Vector3d(1, 0, 0), new Vector3d(0, 0, 1)), new Interval(0, UnitSizeX * UnitCountX), new Interval(0, FrameSizeY), new Interval(-GlassThickness, FrameThickness1)));
      Frame1[i * 2 + 1] = Brep.CreateFromBox(new Box(new Plane(new Point3d(0, 0, UnitSizeY * (i + 1)), new Vector3d(1, 0, 0), new Vector3d(0, 0, 1)), new Interval(0, UnitSizeX * UnitCountX), new Interval(-FrameSizeY, 0), new Interval(-GlassThickness, FrameThickness1)));
    }
    Frame2 = new Brep[UnitCountX * 2];
    for(int i = 0;i < UnitCountX;i++){
      Frame2[i * 2] = Brep.CreateFromBox(new Box(new Plane(new Point3d(UnitSizeX * i, 0, 0), new Vector3d(1, 0, 0), new Vector3d(0, 0, 1)), new Interval(0, FrameSizeX), new Interval(0, UnitSizeY * UnitCountY), new Interval(-GlassThickness, FrameThickness2)));
      Frame2[i * 2 + 1] = Brep.CreateFromBox(new Box(new Plane(new Point3d(UnitSizeX * (i + 1), 0, 0), new Vector3d(1, 0, 0), new Vector3d(0, 0, 1)), new Interval(-FrameSizeX, 0), new Interval(0, UnitSizeY * UnitCountY), new Interval(-GlassThickness, FrameThickness2)));
    }
    Glass = new Brep[UnitCountX * UnitCountY];
    for(int i = 0;i < UnitCountX;i++){
      for(int j = 0;j < UnitCountY;j++){
        Glass[i * UnitCountY + j] = Brep.CreateFromBox(new Box(new Plane(new Point3d(UnitSizeX * i, 0, UnitSizeY * j), new Vector3d(1, 0, 0), new Vector3d(0, 0, 1)), new Interval(FrameSizeX, UnitSizeX - FrameSizeX), new Interval(FrameSizeY, UnitSizeY - FrameSizeY), new Interval(-GlassThickness,0)));
      }
    }
  }
# ---------- end c_script_5 ----------
c_script_6 = CSharpScript(x=crv)  # -> A, B, C; inputs x: list of Curve
# ---------- c_script_6: C# ----------
    Brep[] reta;
    Brep[] retb;
    Brep[] retc;
    GetRailroad(x.ToArray(), out reta, out retb, out retc);
    A = reta;
    B = retb;
    C = retc;
# ---------- c_script_6: C# additional code ----------
  public Curve GetRailroadBallast(double BallastWidthTop, double BallastWidthBottom, double BallastHeight){
    Polyline BallastBasePL = new Polyline(5);
    BallastBasePL.Add(BallastWidthBottom / 2.0, 0, 0);
    BallastBasePL.Add(BallastWidthTop / 2.0, 0, BallastHeight);
    BallastBasePL.Add(-BallastWidthTop / 2.0, 0, BallastHeight);
    BallastBasePL.Add(-BallastWidthBottom / 2.0, 0, 0);
    BallastBasePL.Add(BallastWidthBottom / 2.0, 0, 0);
    return BallastBasePL.ToNurbsCurve();
  }

  public Curve GetRailroadTrackShape(){
    return GetRailroadTrackShape(145.0, 65.0, 49.0, 94.9, 30.1, 16.5);
  }

  public Curve GetRailroadTrackShape(double b, double c, double d, double e, double f, double g){
    Polyline BallastBasePL = new Polyline(11);
    BallastBasePL.Add(b / 2.0, 0, 0);
    BallastBasePL.Add(b / 2.0, 0, f / 2.0);
    BallastBasePL.Add(g / 2.0, 0, f);
    BallastBasePL.Add(g / 2.0, 0, f + e);
    BallastBasePL.Add(c / 2.0, 0, f + e);
    BallastBasePL.Add(c / 2.0, 0, f + e + d);

    BallastBasePL.Add(-c / 2.0, 0, f + e + d);
    BallastBasePL.Add(-c / 2.0, 0, f + e);
    BallastBasePL.Add(-g / 2.0, 0, f + e);
    BallastBasePL.Add(-g / 2.0, 0, f);
    BallastBasePL.Add(-b / 2.0, 0, f / 2.0);
    BallastBasePL.Add(-b / 2.0, 0, 0);

    BallastBasePL.Add(b / 2.0, 0, 0);
    return BallastBasePL.ToNurbsCurve();
  }

  public void GetRailroad(Curve[] RailCurves, out Brep[] Railroad, out Brep[] RailroadTie, out Brep[] TrackBallast){
    double TrackGauge = 1067.0;
    GetRailroad(RailCurves, GetRailroadTrackShape(), TrackGauge, out Railroad, out RailroadTie, out TrackBallast);
  }

  public void GetRailroad(Curve[] RailCurves, Curve TrackShape, double TrackGauge, out Brep[] Railroad, out Brep[] RailroadTie, out Brep[] TrackBallast){
    GetRailroad(RailCurves, TrackShape, TrackGauge, TrackGauge * 2.0, 200, 50, 700, TrackGauge * 2.5, TrackGauge * 3.0, 140, out Railroad, out RailroadTie, out TrackBallast);
  }

  public void GetRailroad(Curve[] RailCurves, Curve TrackShape, double TrackGauge, double TieWidth, double TieLength, double TieHeight, double TieSpace, double BallastWidthTop, double BallastWidthBottom, double BallastHeight, out Brep[] Railroad, out Brep[] RailroadTie, out Brep[] TrackBallast){
    TrackGauge = Math.Abs(TrackGauge);
    List<Brep> ResultRoad = new List<Brep>();
    List<Brep> ResultTie = new List<Brep>();
    List<Brep> ResultBallast = new List<Brep>();

    Brep TieBase = Brep.CreateFromBox(new Box(Plane.WorldXY, new Interval(-TieWidth / 2.0, TieWidth / 2.0), new Interval(-TieLength / 2.0, TieLength / 2.0), new Interval(0, TieHeight)));

    Curve BallastBase = GetRailroadBallast(BallastWidthTop, BallastWidthBottom, BallastHeight);

    foreach(Curve RailCurve in RailCurves){
      RailCurve.Domain = new Interval(0, 1.0);
      double RailLength = RailCurve.GetLength();

      Curve[] OffsetedCurves = new Curve[]{
        (RailCurve.Offset(Plane.WorldXY, TrackGauge / 2.0, TrackGauge / 100.0, CurveOffsetCornerStyle.Smooth))[0],
        (RailCurve.Offset(Plane.WorldXY, -TrackGauge / 2.0, TrackGauge / 100.0, CurveOffsetCornerStyle.Smooth))[0]};
      OffsetedCurves[0].Translate(0, 0, BallastHeight + TieHeight);
      OffsetedCurves[1].Translate(0, 0, BallastHeight + TieHeight);

      for(int i = 0;i <= 1;i++){
        Curve TempTrackShape = (Curve) TrackShape.Duplicate();
        OffsetedCurves[i].Domain = new Interval(0, 1);
        TempTrackShape.Rotate(GetCurvatureAsAngle(OffsetedCurves[i], 0), new Vector3d(0, 0, 1), new Point3d(0, 0, 0));
        TempTrackShape.Translate((Vector3d) OffsetedCurves[i].PointAtStart);
        ResultRoad.Add(Brep.CreateFromSweep(OffsetedCurves[i], TempTrackShape, true, TrackGauge / 1e6)[0].CapPlanarHoles(TrackGauge / 1e6));
      }

      if(TieHeight > 0 && TieWidth > 0){
        for(double CurrentLength = TieSpace;CurrentLength  < RailLength;CurrentLength += TieSpace){
          double TempT;
          RailCurve.LengthParameter(CurrentLength, out TempT);
          Brep TempTie = (Brep) TieBase.Duplicate();
          TempTie.Rotate(GetCurvatureAsAngle(RailCurve, TempT), new Vector3d(0, 0, 1), new Point3d(0, 0, 0));
          TempTie.Translate((Vector3d) (RailCurve.PointAt(TempT)) + new Vector3d(0, 0, BallastHeight));
          ResultTie.Add(TempTie);
        }
      }
      if(BallastHeight > 0){
        Curve TempBallaseBase = (Curve) BallastBase.Duplicate();
        TempBallaseBase.Rotate(GetCurvatureAsAngle(RailCurve, 0), new Vector3d(0, 0, 1), new Point3d(0, 0, 0));
        TempBallaseBase.Translate((Vector3d) RailCurve.PointAtStart);
        ResultBallast.Add(Brep.CreateFromSweep(RailCurve, TempBallaseBase, true, TrackGauge / 1e6)[0].CapPlanarHoles(TrackGauge / 1e6));
      }
    }
    Railroad = ResultRoad.ToArray();
    RailroadTie = ResultTie.ToArray();
    TrackBallast = ResultBallast.ToArray();
  }

  public double GetCurvatureAsAngle(Curve cv, double t){
    Vector3d Curvature = cv.CurvatureAt(t);
    double angle = 0;
    if(Curvature.X == 0){angle = Math.PI / 2.0;}
    else{
      angle = Math.Atan(Curvature.Y / Curvature.X);
    }
    return angle;
  }
# ---------- end c_script_6 ----------
c_script_7 = CSharpScript(x=crv_4)  # -> A, B, C; inputs x: list of Curve; disabled
# ---------- c_script_7: C# ----------
    A = GetTactilePavingPoint();
    B = GetTactilePavingLine();
    C = GetTactilePavingAlongCurve(x.ToArray());
# ---------- c_script_7: C# additional code ----------
  public Brep[] GetTactilePavingAlongCurve(Curve[] Target){
    //Rhino.Geometry.Intersect.Intersection.CurveCurve(
    double UnitSize = 302.5;
    List<Brep> Result = new List<Brep>();

    Brep TPP = GetTactilePavingPoint();
    Brep TPL = GetTactilePavingLine();

    foreach(Curve cv in Target){
      double length = cv.GetLength();
      double t;
      Vector3d Normal;
      cv.Domain = new Interval(0, 1);
      if(length < UnitSize * 3){
        Normal = cv.CurvatureAt(0);
        cv.LengthParameter(length / 2.0, out t);
        Result.Add(GetTactilePavingAlongCurveHelper1(TPP, cv, t));
      }
      Result.AddRange(GetTactilePavingAlongCurveHelper2(TPP, cv, 0, UnitSize));
      double CurrentLen = 0;
      for(CurrentLen = UnitSize;CurrentLen + UnitSize < length;CurrentLen += UnitSize){
        cv.LengthParameter(CurrentLen, out t);
        Result.Add(GetTactilePavingAlongCurveHelper1(TPL, cv, t));
      }
      cv.LengthParameter(CurrentLen, out t);
      Result.AddRange(GetTactilePavingAlongCurveHelper2(TPP, cv, t, UnitSize));
    }
    return Result.ToArray();
  }

  private Brep GetTactilePavingAlongCurveHelper1(Brep Origin, Curve cv, double t){
    return GetTactilePavingAlongCurveHelper1(Origin, cv, t, GetCurvatureAsAngle(cv, t));
  }

  private Brep GetTactilePavingAlongCurveHelper1(Brep Origin, Curve cv, double t, double angle){
    return GetTactilePavingAlongCurveHelper1(Origin, cv.PointAt(t), GetCurvatureAsAngle(cv, t));
  }

  private Brep GetTactilePavingAlongCurveHelper1(Brep Origin, Point3d point, double angle){
    Brep TempTP = (Brep) Origin.Duplicate();
    angle += Math.PI / 2.0;
    TempTP.Rotate(angle, new Vector3d(0, 0, 1), new Point3d(0, 0, 0));
    TempTP.Translate((Vector3d) point);
    return TempTP;
  }

  private Brep[] GetTactilePavingAlongCurveHelper2(Brep Origin, Curve cv, double t, double UnitSize){
    double angle = GetCurvatureAsAngle(cv, t);
    Vector3d Curvature = cv.CurvatureAt(t);
    Curvature /= Curvature.Length;
    return new Brep[]{ GetTactilePavingAlongCurveHelper1(Origin, cv.PointAt(t), angle)
      ,GetTactilePavingAlongCurveHelper1(Origin, cv.PointAt(t) + (Curvature * UnitSize), angle)
      ,GetTactilePavingAlongCurveHelper1(Origin, cv.PointAt(t) - (Curvature * UnitSize), angle)
      };
  }

  public double GetCurvatureAsAngle(Curve cv, double t){
    Vector3d Curvature = cv.CurvatureAt(t);
    double angle = 0;
    if(Curvature.X == 0){angle = Math.PI / 2.0;}
    else{
      angle = Math.Atan(Curvature.Y / Curvature.X);
    }
    return angle;
  }

  public Brep GetTactilePavingPoint(){
    return GetTactilePavingPoint(300, 5, 12, 22, 5, 60, 5);
  }

  public Brep GetTactilePavingPoint(double BlockSize, int PointCount, double PointSizeTop, double PointSizeBottom, double PointHeight, double PointSpace, double BlockThickness){
    Brep[] Result = new Brep[1 + PointCount * PointCount];
    Result[0] = Brep.CreateFromBox(new Box(Plane.WorldXY, new Interval(-BlockSize / 2.0, BlockSize / 2.0), new Interval(-BlockSize / 2.0, BlockSize / 2.0), new Interval(0, BlockThickness)));

    Brep BasicShape = (Brep.CreateFromLoft(
      new Curve[]{
      NurbsCurve.CreateFromCircle(new Circle(new Point3d(0, 0, BlockThickness / 2.0), PointSizeBottom))
      ,NurbsCurve.CreateFromCircle(new Circle(new Point3d(0, 0, BlockThickness), PointSizeBottom))
      ,NurbsCurve.CreateFromCircle(new Circle(new Point3d(0, 0, BlockThickness + PointHeight), PointSizeTop))}, new Point3d(0, 0, BlockThickness), new Point3d(0, 0, BlockThickness + PointHeight), LoftType.Straight, false))[0];
    BasicShape.CapPlanarHoles(PointSizeTop / 100.0);

    for(int i = 0;i < PointCount;i++){
      for(int j = 0;j < PointCount;j++){
        Brep TempShape = (Brep) BasicShape.Duplicate();
        TempShape.Translate((i - PointCount / 2.0 + 0.5) * PointSpace, (j - PointCount / 2.0 + 0.5) * PointSpace, 0);
        Result[i * PointCount + j + 1] = TempShape;
      }
    }
    return (Brep.CreateBooleanUnion(Result, PointSizeTop / 100.0))[0];
  }

  public Brep GetTactilePavingLine(){
    return GetTactilePavingLine(300, 4, 17, 27, 270, 5, 75, 5);
  }

  public Brep GetTactilePavingLine(double BlockSize, int LineCount, double LineWidthTop, double LineWidthBottom, double LineLength, double LineHeight, double LineSpace, double BlockThickness){
    LineLength -= LineWidthTop;

    Brep[] Result = new Brep[1 + LineCount * LineCount];
    Result[0] = Brep.CreateFromBox(new Box(Plane.WorldXY, new Interval(-BlockSize / 2.0, BlockSize / 2.0), new Interval(-BlockSize / 2.0, BlockSize / 2.0), new Interval(0, BlockThickness)));

    Curve BottomCurve = Curve.JoinCurves(new Curve[]{
      NurbsCurve.CreateFromArc(new Arc(new Circle(new Point3d(-LineLength / 2.0, 0, 0), LineWidthBottom / 2.0), new Interval(Math.PI / 2.0, Math.PI / 2.0 * 3.0))),
      NurbsCurve.CreateFromArc(new Arc(new Circle(new Point3d(LineLength / 2.0, 0, 0), LineWidthBottom / 2.0), new Interval(-Math.PI / 2.0, Math.PI / 2.0))),
      NurbsCurve.CreateFromLine(new Line(new Point3d(-LineLength / 2.0, LineWidthBottom / 2.0, 0), new Point3d(LineLength / 2.0, LineWidthBottom / 2.0, 0))),
      NurbsCurve.CreateFromLine(new Line(new Point3d(-LineLength / 2.0, -LineWidthBottom / 2.0, 0), new Point3d(LineLength / 2.0, -LineWidthBottom / 2.0, 0)))})[0];
    Curve MiddleCurve = (Curve) BottomCurve.Duplicate();
    BottomCurve.Translate(0, 0, BlockThickness / 2.0);
    MiddleCurve.Translate(0, 0, BlockThickness);
    Curve TopCurve = Curve.JoinCurves(new Curve[]{
      NurbsCurve.CreateFromArc(new Arc(new Circle(new Point3d(-LineLength / 2.0, 0, 0), LineWidthTop / 2.0), new Interval(Math.PI / 2.0, Math.PI / 2.0 * 3.0))),
      NurbsCurve.CreateFromArc(new Arc(new Circle(new Point3d(LineLength / 2.0, 0, 0), LineWidthTop / 2.0), new Interval(-Math.PI / 2.0, Math.PI / 2.0))),
      NurbsCurve.CreateFromLine(new Line(new Point3d(-LineLength / 2.0, LineWidthTop / 2.0, 0), new Point3d(LineLength / 2.0, LineWidthTop / 2.0, 0))),
      NurbsCurve.CreateFromLine(new Line(new Point3d(-LineLength / 2.0, -LineWidthTop / 2.0, 0), new Point3d(LineLength / 2.0, -LineWidthTop / 2.0, 0)))})[0];
    TopCurve.Translate(0, 0, BlockThickness + LineHeight);


    Brep BasicShape = (Brep.CreateFromLoft(
      new Curve[]{BottomCurve,MiddleCurve,TopCurve}, new Point3d(0, 0, BlockThickness), new Point3d(0, 0, BlockThickness + LineHeight), LoftType.Straight, false))[0];
    BasicShape.CapPlanarHoles(LineWidthTop / 100.0);

    for(int i = 0;i < LineCount;i++){
      Brep TempShape = (Brep) BasicShape.Duplicate();
      TempShape.Translate(0, (i - LineCount / 2.0 + 0.5) * LineSpace, 0);
      Result[i + 1] = TempShape;
    }
    return (Brep.CreateBooleanUnion(Result, LineWidthTop / 100.0))[0];
  }
# ---------- end c_script_7 ----------
c_script_8 = CSharpScript()  # -> A, B; disabled
# ---------- c_script_8: C# ----------
    A = GetTactilePavingPoint();
    B = GetTactilePavingLine();
# ---------- c_script_8: C# additional code ----------
  public Brep[] GetTactilePavingPoint(){
    return GetTactilePavingPoint(300, 5, 12, 22, 5, 60, 5);
  }

  public Brep[] GetTactilePavingPoint(double BlockSize, int PointCount, double PointSizeTop, double PointSizeBottom, double PointHeight, double PointSpace, double BlockThickness){
    Brep[] Result = new Brep[1 + PointCount * PointCount];
    Result[0] = Brep.CreateFromBox(new Box(Plane.WorldXY, new Interval(-BlockSize / 2.0, BlockSize / 2.0), new Interval(-BlockSize / 2.0, BlockSize / 2.0), new Interval(0, BlockThickness)));

    Brep BasicShape = (Brep.CreateFromLoft(
      new Curve[]{
      NurbsCurve.CreateFromCircle(new Circle(new Point3d(0, 0, BlockThickness / 2.0), PointSizeBottom))
      ,NurbsCurve.CreateFromCircle(new Circle(new Point3d(0, 0, BlockThickness), PointSizeBottom))
      ,NurbsCurve.CreateFromCircle(new Circle(new Point3d(0, 0, BlockThickness + PointHeight), PointSizeTop))}, new Point3d(0, 0, BlockThickness), new Point3d(0, 0, BlockThickness + PointHeight), LoftType.Straight, false))[0];
    BasicShape.CapPlanarHoles(PointSizeTop / 100.0);

    for(int i = 0;i < PointCount;i++){
      for(int j = 0;j < PointCount;j++){
        Brep TempShape = (Brep) BasicShape.Duplicate();
        TempShape.Translate((i - PointCount / 2.0 + 0.5) * PointSpace, (j - PointCount / 2.0 + 0.5) * PointSpace, 0);
        Result[i * PointCount + j + 1] = TempShape;
      }
    }
    return Brep.CreateBooleanUnion(Result, PointSizeTop / 100.0);
  }

  public Brep[] GetTactilePavingLine(){
    return GetTactilePavingLine(300, 4, 17, 27, 270, 5, 75, 5);
  }

  public Brep[] GetTactilePavingLine(double BlockSize, int LineCount, double LineWidthTop, double LineWidthBottom, double LineLength, double LineHeight, double LineSpace, double BlockThickness){
    LineLength -= LineWidthTop;
    
    Brep[] Result = new Brep[1 + LineCount * LineCount];
    Result[0] = Brep.CreateFromBox(new Box(Plane.WorldXY, new Interval(-BlockSize / 2.0, BlockSize / 2.0), new Interval(-BlockSize / 2.0, BlockSize / 2.0), new Interval(0, BlockThickness)));

    Curve BottomCurve = Curve.JoinCurves(new Curve[]{
      NurbsCurve.CreateFromArc(new Arc(new Circle(new Point3d(-LineLength / 2.0, 0, 0), LineWidthBottom / 2.0), new Interval(Math.PI / 2.0, Math.PI / 2.0 * 3.0))),
      NurbsCurve.CreateFromArc(new Arc(new Circle(new Point3d(LineLength / 2.0, 0, 0), LineWidthBottom / 2.0), new Interval(-Math.PI / 2.0, Math.PI / 2.0))),
      NurbsCurve.CreateFromLine(new Line(new Point3d(-LineLength / 2.0, LineWidthBottom / 2.0, 0), new Point3d(LineLength / 2.0, LineWidthBottom / 2.0, 0))),
      NurbsCurve.CreateFromLine(new Line(new Point3d(-LineLength / 2.0, -LineWidthBottom / 2.0, 0), new Point3d(LineLength / 2.0, -LineWidthBottom / 2.0, 0)))})[0];
    Curve MiddleCurve = (Curve) BottomCurve.Duplicate();
    BottomCurve.Translate(0, 0, BlockThickness / 2.0);
    MiddleCurve.Translate(0, 0, BlockThickness);
    Curve TopCurve = Curve.JoinCurves(new Curve[]{
      NurbsCurve.CreateFromArc(new Arc(new Circle(new Point3d(-LineLength / 2.0, 0, 0), LineWidthTop / 2.0), new Interval(Math.PI / 2.0, Math.PI / 2.0 * 3.0))),
      NurbsCurve.CreateFromArc(new Arc(new Circle(new Point3d(LineLength / 2.0, 0, 0), LineWidthTop / 2.0), new Interval(-Math.PI / 2.0, Math.PI / 2.0))),
      NurbsCurve.CreateFromLine(new Line(new Point3d(-LineLength / 2.0, LineWidthTop / 2.0, 0), new Point3d(LineLength / 2.0, LineWidthTop / 2.0, 0))),
      NurbsCurve.CreateFromLine(new Line(new Point3d(-LineLength / 2.0, -LineWidthTop / 2.0, 0), new Point3d(LineLength / 2.0, -LineWidthTop / 2.0, 0)))})[0];
    TopCurve.Translate(0, 0, BlockThickness + LineHeight);


    Brep BasicShape = (Brep.CreateFromLoft(
      new Curve[]{BottomCurve,MiddleCurve,TopCurve}, new Point3d(0, 0, BlockThickness), new Point3d(0, 0, BlockThickness + LineHeight), LoftType.Straight, false))[0];
    BasicShape.CapPlanarHoles(LineWidthTop / 100.0);

    for(int i = 0;i < LineCount;i++){
      Brep TempShape = (Brep) BasicShape.Duplicate();
      TempShape.Translate(0, (i - LineCount / 2.0 + 0.5) * LineSpace, 0);
      Result[i + 1] = TempShape;
    }
    return Brep.CreateBooleanUnion(Result, LineWidthTop / 100.0);
  }
# ---------- end c_script_8 ----------
c_script_9 = CSharpScript()  # -> A; disabled
# ---------- c_script_9: C# ----------
    A = GesStairsSolid(25, 900, 230, 200, 300);
# ---------- c_script_9: C# additional code ----------
  public Brep GesStairsSolid(int Count, double StairWidth, double StairHeight, double StairLength, double StairThicknss){
    StairThicknss = Math.Max(1, Math.Abs(StairThicknss));
    Rhino.Geometry.Polyline pl = new Polyline(4 + Count * 2);
    pl.Add(0, StairLength * (Count ), StairHeight * (Count ));
    pl.Add(0, StairLength * (Count ), StairHeight * (Count ) - StairThicknss);
    pl.Add(0, StairLength, StairHeight - StairThicknss);
    pl.Add(0, 0, StairHeight - StairThicknss);
    for(int i = 1;i <= Count;i++){
      pl.Add(0, StairLength * (i - 1), StairHeight * i);
      pl.Add(0, StairLength * (i ), StairHeight * i);
    }
    return Brep.CreateFromSurface(Surface.CreateExtrusion((pl.ToNurbsCurve()), new Vector3d(StairWidth, 0, 0))).CapPlanarHoles(0);
  }

  public Brep[] GetStairsSimple(int Count, double StairWidth, double StairHeight, double StairLength1, double StairLength2, double StairThickness){
    Brep[] result = new Brep[Count];
    for(int i = 1;i <= Count;i++){
      result[i - 1] = Brep.CreateFromBox(new Box(new Plane(new Point3d(0, StairLength2 * (i - 1), StairHeight * i), new Vector3d(1, 0, 0), new Vector3d(0, 1, 0))
        , new Interval(0, StairWidth), new Interval(0, StairLength1), new Interval(-StairThickness, 0)));
    }
    return result;
  }

  public void GetStairsBasic(int Count, double StairWidth, double StairHeight, double StairLength1, double StairLength2, double StairThickness, double OtherThickness, out Brep[] Stairs, out Brep[] Other){
    Stairs = GetStairsSimple(Count, StairWidth, StairHeight, StairLength1, StairLength2, StairThickness);

    Rhino.Geometry.Polyline pl = new Polyline(7);
    pl.Add(0, 0, StairHeight - StairThickness);
    pl.Add(0, StairLength1, StairHeight - StairThickness);
    pl.Add(0, StairLength1 + StairLength2 * Count, StairHeight * (Count + 1) - StairThickness);
    pl.Add(0, StairLength1 + StairLength2 * Count, StairHeight * (Count + 1));
    pl.Add(0, StairLength2 * Count, StairHeight * (Count + 1));
    pl.Add(0, 0, StairHeight);
    pl.Add(0, 0, StairHeight - StairThickness);

    Curve plc = pl.ToNurbsCurve();
    Brep otherSrf1 = Brep.CreateFromSurface(Surface.CreateExtrusion(plc, new Vector3d(-OtherThickness, 0, 0))).CapPlanarHoles(0);
    Brep otherSrf2 = (Brep) otherSrf1.Duplicate();
    otherSrf2.Translate(StairWidth + OtherThickness, 0, 0);
    Other = new Brep[]{otherSrf1,otherSrf2};
  }
# ---------- end c_script_9 ----------
c_script_10 = CSharpScript(x=crv_5)  # -> out, A; inputs x: list of Curve; disabled
# ---------- c_script_10: C# ----------
    try{
      A = GetOutlineSimple(x.ToArray(), new double[]{10000,5000});
    }catch(Exception e){
      Print(e.Message);
      Print(e.StackTrace);
    }
# ---------- c_script_10: C# additional code ----------
  public Curve[] GetOutlineSimple(Curve[] Origin, double Width){
    Curve[] OutlineCurveBase = new Curve[Origin.GetLength(0)];
    for(int i = 0;i < Origin.GetLength(0);i++){
      OutlineCurveBase[i] = GetCurveWithWidth(Origin[i], Width);
    }
    return Curve.CreateBooleanUnion(OutlineCurveBase);
  }

  public Curve[] GetOutlineSimple(Curve[] Origin, double[] Width){
    Curve[] OutlineCurveBase = new Curve[Origin.GetLength(0)];
    for(int i = 0;i < Origin.GetLength(0);i++){
      OutlineCurveBase[i] = GetCurveWithWidth(Origin[i], Width[Math.Min(i,Width.GetLength(0)-1)]);
    }
    return Curve.CreateBooleanUnion(OutlineCurveBase);
  }  

/*
  public Curve[] GetOutline(Curve[] Origin, double Width){
    double OffsetWidth = Width / 2.0;
    Curve[] OffsetCurveOrigin1 = new Curve[Origin.GetLength(0)];
    Curve[] OffsetCurveOrigin2 = new Curve[Origin.GetLength(0)];
    List<Curve>[] OffsetCurve1 = new List<Curve>[Origin.GetLength(0) * 2];

    for(int i = 0;i < Origin.GetLength(0);i++){
      OffsetCurveOrigin1[i] = (Origin[i].Offset(Plane.WorldXY, OffsetWidth, OffsetWidth / 100.0, Rhino.Geometry.CurveOffsetCornerStyle.Sharp))[0];
      OffsetCurveOrigin2[i] = (Origin[i].Offset(Plane.WorldXY, -OffsetWidth, OffsetWidth / 100.0, Rhino.Geometry.CurveOffsetCornerStyle.Sharp))[0];
      OffsetCurve1[i] = new List<Curve>(){(Curve) OffsetCurveOrigin1[i].Duplicate()};
      OffsetCurve1[i + Origin.GetLength(0)] = new List<Curve>(){(Curve) OffsetCurveOrigin2[i].Duplicate()};
    }
    for(int i = 0;i < Origin.GetLength(0);i++){
      for(int j = 0;j < OffsetCurve1.GetLength(0);j++){
        if(i == j || i == j - OffsetCurve1.GetLength(0))continue;

        List<Curve> NewCurve1 = new List<Curve>(OffsetCurve1[j]);
        foreach(Curve TempCV in OffsetCurve1[j]){
          Rhino.Geometry.Intersect.CurveIntersections curveIntersectRet1 = Rhino.Geometry.Intersect.Intersection.CurveCurve(TempCV, OffsetCurveOrigin1[i], Width / 200.0, Width / 200.0);
          Rhino.Geometry.Intersect.CurveIntersections curveIntersectRet2 = Rhino.Geometry.Intersect.Intersection.CurveCurve(TempCV, OffsetCurveOrigin2[i], Width / 200.0, Width / 200.0);

          int LastChoice = -1;
          int k = 0;
          int l = 0;
          int OffsetCount = 0;
          int Choice = -1;
          List<double> Paramaters = new List<double>();

          while(k < curveIntersectRet1.Count || l < curveIntersectRet2.Count){
            if((l >= curveIntersectRet2.Count) || (k < curveIntersectRet1.Count && curveIntersectRet1[k].ParameterA < curveIntersectRet2[l].ParameterA)){
              Paramaters.Add(curveIntersectRet1[k].ParameterA);

              if(LastChoice == 1){Choice = (OffsetCount) % 2;}
              LastChoice = 0;
              k++;
            }else{
              Paramaters.Add(curveIntersectRet2[l].ParameterA);

              if(LastChoice == 0){Choice = (OffsetCount) % 2;}
              LastChoice = 1;
              l++;
            }
          }
          if(Choice == -1){Choice = 1;}
          OffsetCount++;

          Curve[] SplitResult = TempCV.Split(Paramaters);

          if(SplitResult.GetLength(0) > 1){
            NewCurve1.Remove(TempCV);
            for(int m = 0;m < SplitResult.GetLength(0);m++){
              if(m % 2 == Choice){
                NewCurve1.Add(SplitResult[m]);
              }
            }
          }
        }
        OffsetCurve1[j] = NewCurve1;
      }
    }
    List<Curve> ResultBeforeJoin = new List<Curve>();
    for(int i = 0;i < OffsetCurve1.GetLength(0);i++){
      ResultBeforeJoin.AddRange(OffsetCurve1[i]);
    }
    for(int i = 0;i < Origin.GetLength(0);i++){
      ResultBeforeJoin.Add(NurbsCurve.CreateFromLine(new Line(OffsetCurveOrigin1[i].PointAtStart, OffsetCurveOrigin2[i].PointAtStart)));
      ResultBeforeJoin.Add(NurbsCurve.CreateFromLine(new Line(OffsetCurveOrigin1[i].PointAtEnd, OffsetCurveOrigin2[i].PointAtEnd)));
    }
    Curve[] JoinedCurve = Curve.JoinCurves(ResultBeforeJoin);
    List<Curve> FinalResult = new List<Curve>();
    foreach(Curve cv in JoinedCurve){
      if(cv.IsClosed)FinalResult.Add(cv);
    }
    return FinalResult.ToArray();
  }
*/
  public Curve GetCurveWithWidth(Curve Origin, double Width){
    Width /= 2;
    Curve cv1 = (Origin.Offset(Plane.WorldXY, Width, Width / 100.0, Rhino.Geometry.CurveOffsetCornerStyle.Sharp))[0];
    Curve cv2 = (Origin.Offset(Plane.WorldXY, -Width, Width / 100.0, Rhino.Geometry.CurveOffsetCornerStyle.Sharp))[0];

    return (Curve.JoinCurves(new Curve[]{cv1,cv2,NurbsCurve.CreateFromLine(new Line(cv1.PointAtEnd, cv2.PointAtEnd)),NurbsCurve.CreateFromLine(new Line(cv1.PointAtStart, cv2.PointAtStart))}))[0];
  }

  public Curve[] GetDashedLine(Curve Origin, double SegmentLength){
    int Count = (int) Math.Floor(Origin.GetLength() / SegmentLength / 2.0);
    Curve[] result = new Curve[Count + 1];

    for(int i = 0;i <= Count ;i++){
      Curve TempCurve = (Curve) Origin.Duplicate();
      Point3d a = TempCurve.PointAtLength(i * SegmentLength * 2.0);
      Point3d b = TempCurve.PointAtLength(i * SegmentLength * 2.0 + SegmentLength);
      double at,bt;
      TempCurve.ClosestPoint(a, out at);
      TempCurve.ClosestPoint(b, out bt);
      TempCurve = (TempCurve.Split(new double[]{at,bt}))[i == 0 ? 0 : 1];
      result[i] = TempCurve;
    }
    return result;
  }
# ---------- end c_script_10 ----------
c_script_11 = CSharpScript()  # -> A, B; disabled
# ---------- c_script_11: C# ----------
    //    A = GetStairsSimple(25, 900, 230, 200, 180, 50);
    Brep[] st;
    Brep[] ot;
    GetStairsBasic(25, 900, 230, 200, 180, 50, 50, out st, out ot);
    A = st;
    B = ot;
# ---------- c_script_11: C# additional code ----------
  public Brep GesStairsSolid(int Count, double StairWidth, double StairHeight, double StairLength){
    Rhino.Geometry.Polyline pl = new Polyline(4 + Count * 2);
    pl.Add(0, StairLength * (Count + 1), StairHeight * (Count + 1));
    pl.Add(0, StairLength * (Count + 1), StairHeight * (Count + 1) - StairHeight);
    pl.Add(0, StairLength, StairHeight - StairHeight);
    pl.Add(0, 0, StairHeight - StairHeight);
    for(int i = 1;i <= Count;i++){
      pl.Add(0, StairLength * (i - 1), StairHeight * i);
      pl.Add(0, StairLength * (i ), StairHeight * i);
    }
    return Brep.CreateFromSurface(Surface.CreateExtrusion((pl.ToNurbsCurve()), new Vector3d(-StairWidth, 0, 0))).CapPlanarHoles(0);
  }

  public Brep[] GetStairsSimple(int Count, double StairWidth, double StairHeight, double StairLength1, double StairLength2, double StairThickness){
    Brep[] result = new Brep[Count];
    for(int i = 1;i <= Count;i++){
      result[i - 1] = Brep.CreateFromBox(new Box(new Plane(new Point3d(0, StairLength2 * (i - 1), StairHeight * i), new Vector3d(1, 0, 0), new Vector3d(0, 1, 0))
        , new Interval(0, StairWidth), new Interval(0, StairLength1), new Interval(-StairThickness, 0)));
    }
    return result;
  }

  public void GetStairsBasic(int Count, double StairWidth, double StairHeight, double StairLength1, double StairLength2, double StairThickness, double OtherThickness, out Brep[] Stairs, out Brep[] Other){
    Stairs = GetStairsSimple(Count, StairWidth, StairHeight, StairLength1, StairLength2, StairThickness);

    Rhino.Geometry.Polyline pl = new Polyline(7);
    pl.Add(0, 0, StairHeight - StairThickness);
    pl.Add(0, StairLength1, StairHeight - StairThickness);
    pl.Add(0, StairLength1 + StairLength2 * Count, StairHeight * (Count + 1) - StairThickness);
    pl.Add(0, StairLength1 + StairLength2 * Count, StairHeight * (Count + 1));
    pl.Add(0, StairLength2 * Count, StairHeight * (Count + 1));
    pl.Add(0, 0, StairHeight);
    pl.Add(0, 0, StairHeight - StairThickness);

    Curve plc = pl.ToNurbsCurve();
    Brep otherSrf1 = Brep.CreateFromSurface(Surface.CreateExtrusion(plc, new Vector3d(-OtherThickness, 0, 0))).CapPlanarHoles(0);
    Brep otherSrf2 = (Brep) otherSrf1.Duplicate();
    otherSrf2.Translate(StairWidth + OtherThickness, 0, 0);
    Other = new Brep[]{otherSrf1,otherSrf2};
  }
# ---------- end c_script_11 ----------
crv_6 = Curve(c_script_4)  # disabled
brep = Brep(c_script_6.A)
brep_2 = Brep(c_script_6.C)
brep_3 = Brep(c_script_6.B)
brep_4 = Brep(c_script_7.C)  # disabled
brep_5 = Brep(c_script.Frame)  # disabled
brep_6 = Brep(c_script.Glass)  # disabled
brep_7 = Brep(c_script_3.Frame)  # disabled
brep_8 = Brep(c_script_3.Wall)  # disabled
brep_9 = Brep(c_script_3.Spandrel)  # disabled
brep_10 = Brep(c_script_3.Loof)  # disabled
brep_11 = Brep(c_script_3.Glass)  # disabled
brep_12 = Brep(c_script_3.Floor)  # disabled
crv_7 = Curve(c_script_10.A)  # disabled
brep_13 = Brep(c_script_2.Frame)  # disabled
brep_14 = Brep(c_script_2.Glass)  # disabled
brep_15 = Brep(c_script_3.Ceiling)  # disabled
brep_16 = Brep(c_script_5.A)  # disabled
brep_17 = Brep(c_script_2.Spandrel)  # disabled
brep_18 = Brep(c_script_5.B)  # disabled
brep_19 = Brep(c_script_5.C)  # disabled
brep_20 = Brep(c_script_9)  # disabled
brep_21 = Brep(c_script_11.A)  # disabled
panel = Panel(c_script_10.out)  # disabled
brep_22 = Brep(c_script_11.B)  # disabled
c_script_12 = CSharpScript(x=brep_16)  # -> A; inputs x: list of Brep; disabled
# ---------- c_script_12: C# ----------
    A = AddRandomMove(x.ToArray(), 0, Math.PI / 180.0 * 0.5);
# ---------- c_script_12: C# additional code ----------
  public Brep[] AddRandomMove(Brep[] Origin, double Coordinate, double Angle){return AddRandomMove(Origin, Coordinate, Coordinate, Coordinate, Angle, Angle, Angle);}
  public Brep[] AddRandomMove(Brep[] Origin, double x, double y, double z, double AngleX, double AngleY, double AngleZ){return AddRandomMove(Origin, x, y, z, AngleX, AngleY, AngleZ, new Random());}

  public Brep[] AddRandomMove(Brep[] Origin, double x, double y, double z, double AngleX, double AngleY, double AngleZ, Random rnd){
    Brep[] Result = new Brep[Origin.GetLength(0)];

    for(int i = 0;i < Origin.GetLength(0);i++){
      Point3d CenterPoint = new Point3d(0, 0, 0);
      foreach(BrepVertex bv in Origin[i].Vertices){
        CenterPoint += bv.Location;
      }
      CenterPoint /= Origin[i].Vertices.Count;

      Result[i] = (Brep) Origin[i].Duplicate();
      Result[i].Translate((rnd.NextDouble() * 2.0 - 1.0) * x, (rnd.NextDouble() * 2.0 - 1.0) * y, (rnd.NextDouble() * 2.0 - 1.0) * z);
      Result[i].Rotate((rnd.NextDouble() * 2.0 - 1.0) * AngleX, new Vector3d(1, 0, 0), CenterPoint);
      Result[i].Rotate((rnd.NextDouble() * 2.0 - 1.0) * AngleY, new Vector3d(0, 1, 0), CenterPoint);
      Result[i].Rotate((rnd.NextDouble() * 2.0 - 1.0) * AngleZ, new Vector3d(0, 0, 1), CenterPoint);
    }

    return Result;
  }
# ---------- end c_script_12 ----------
brep_23 = Brep(c_script_12)  # disabled
