# Grasshopper definition Building2.1.gh (Grasshopper 0.9.76)

number_slider = Slider(100, range=0..100)  # disabled
japaneseroof = CSharpScript()  # -> out, A, B; disabled
# ---------- japaneseroof: C# ----------
    Brep[] a;
    Brep[] b;
    double RoofLen = 10*1000;
    GetJapaneseRoof(RoofLen, RoofLen + 1000, 1000, 0.3, 100, 500, 50, 50, out a, out b);
    A = a;
    B = b;
# ---------- japaneseroof: C# additional code ----------
  public static void GetJapaneseRoof(double LengthTop, double LengthBottom, double Depth, double Pitch, double Height, double RafterSpace, double RafterWidth, double RafterHeight, out Brep[] Main, out Brep[] Rafter){
    Main = GetJapaneseRoofMain(LengthTop, LengthBottom, Depth, Pitch, Height);
    Rafter = GetJapaneseRoofRafter(LengthTop, LengthBottom, Depth, Pitch, Height, RafterSpace, RafterWidth, RafterHeight);
  }

  public static Brep[] GetJapaneseRoofRafter(double LengthTop, double LengthBottom, double Depth, double Pitch, double Height, double RafterSpace, double RafterWidth, double RafterHeight){
    List<Brep> Lafters = new List<Brep>();
    double RafterSpaceBottom = LengthBottom / Math.Floor(LengthBottom / RafterSpace);
    double RafterSpaceTop = LengthTop / Math.Floor(LengthBottom / RafterSpace);

    Curve SectionBase;
    {
      Polyline SectionPL = new Polyline(5);
      SectionPL.Add(RafterWidth / 2.0, 0, 0);
      SectionPL.Add(RafterWidth / 2.0, 0, -RafterHeight);
      SectionPL.Add(-RafterWidth / 2.0, 0, -RafterHeight);
      SectionPL.Add(-RafterWidth / 2.0, 0, 0);
      SectionPL.Add(RafterWidth / 2.0, 0, 0);

      SectionBase = SectionPL.ToNurbsCurve();
    }

    double CurrentPositonTop = -LengthTop / 2.0 + RafterSpaceTop;
    double CurrentPositonBottom = -LengthBottom / 2.0 + RafterSpaceBottom;
    for(;CurrentPositonBottom <= LengthBottom / 2.0 - RafterSpaceBottom;CurrentPositonBottom += RafterSpaceBottom,CurrentPositonTop += RafterSpaceTop){
      Point3d PointTop = new Point3d(CurrentPositonTop, 0, -Height);
      Point3d PointBottom = new Point3d(CurrentPositonBottom, -Depth, -Depth * Pitch - Height);

      Curve TempCurve1 = (Curve) SectionBase.Duplicate();
      TempCurve1.Translate((Vector3d) PointTop);
      Lafters.Add(Brep.CreateFromSurface(Surface.CreateExtrusion(TempCurve1, PointBottom - PointTop)).CapPlanarHoles(Height / 100.0));
    }
    return Lafters.ToArray();
  }

  public static Brep[] GetJapaneseRoofMain(double LengthTop, double LengthBottom, double Depth, double Pitch, double Height){
    List<Brep> ResultRoof = new List<Brep>();
    Polyline RoofPL = new Polyline(5);
    RoofPL.Add(LengthTop / 2.0, 0, 0);
    RoofPL.Add(LengthBottom / 2.0, -Depth, -Depth * Pitch);
    RoofPL.Add(-LengthBottom / 2.0, -Depth, -Depth * Pitch);
    RoofPL.Add(-LengthTop / 2.0, 0, 0);
    RoofPL.Add(LengthTop / 2.0, 0, 0);

    Curve RoofCurve = RoofPL.ToNurbsCurve();
    Brep RoofPlanar = (Brep.CreatePlanarBreps(RoofCurve))[0];
    ResultRoof.Add(RoofPlanar);
    RoofPlanar = (Brep) RoofPlanar.Duplicate();
    RoofPlanar.Translate(0, 0, -Height);
    ResultRoof.Add(RoofPlanar);

    ResultRoof.Add(Brep.CreateFromSurface(Surface.CreateExtrusion(RoofCurve, new Vector3d(0, 0, -Height))));
    return Brep.CreateSolid(ResultRoof, Height / 100.0);
  }
# ---------- end japaneseroof ----------
Y = UnitY(Factor=number_slider)  # disabled
frame2d = CSharpScript()  # -> out, A, B; disabled
# ---------- frame2d: C# ----------
    Brep[] a,b;
    GetGlassWindowLight(40, 40, 1000, 2500, 100, 10, out a, out b);
    A = a;B = b;
# ---------- frame2d: C# additional code ----------
  public static void GetGlassWindowLight(int CountX, int CountY, double Width, double Height, double FrameWidth, double GlassThickness, out Brep[] Glass, out Brep[] Frame){
    {
      Polyline secPL = new Polyline(5);
      secPL.Add(0, 0, 0);
      secPL.Add(Width * CountX, 0, 0);
      secPL.Add(Width * CountX, 0, Height * CountY);
      secPL.Add(0, 0, Height * CountY);
      secPL.Add(0, 0, 0);

      List<Brep> GlassBrep = new List<Brep>();
      Curve secCv = secPL.ToNurbsCurve();
      GlassBrep.AddRange(Brep.CreatePlanarBreps(secCv));
      GlassBrep.Add(Brep.CreateFromSurface(Surface.CreateExtrusion(secCv, new Vector3d(0, GlassThickness, 0))));
      secCv.Translate(0, GlassThickness, 0);
      GlassBrep.AddRange(Brep.CreatePlanarBreps(secCv));
      Glass = Brep.CreateSolid(GlassBrep, GlassThickness / 100.0);
    }
    Brep[] ResultFrame = GetFrame2d(CountX, CountY, Width, Height, FrameWidth, FrameWidth, FrameWidth, FrameWidth);
    for(int i = 0;i < ResultFrame.GetLength(0);i++){
      ResultFrame[i].Translate(0, -GlassThickness, 0);
    }
    Frame = ResultFrame;
  }

  public static Brep[] CreateExtrusionCaped(Curve[] Section, Vector3d Direction){
    List<Brep> Result = new List<Brep>();

    Brep[] BaseBrep = Brep.CreatePlanarBreps(Section);
    Result.AddRange(BaseBrep);
    foreach(Brep bp in BaseBrep){
      Brep TempBrep = (Brep) bp.Duplicate();
      TempBrep.Translate(Direction);
      Result.Add(TempBrep);
    }
    foreach(Curve cv in Section){
      Result.Add(Brep.CreateFromSurface(Surface.CreateExtrusion(cv, Direction)));
    }
    return Brep.CreateSolid(Result, 0.10);
  }

  public static Brep[] GetFrame2d(int CountX, int CountY, double Width, double Height, double FrameWidthTop, double FrameWidthLeft, double FrameWidthRight, double FrameWidthBottom){
    Curve RecBase;
    {
      Polyline recPL = new Polyline(5);
      recPL.Add(FrameWidthRight, 0, FrameWidthBottom);
      recPL.Add(Width - FrameWidthLeft, 0, FrameWidthBottom);
      recPL.Add(Width - FrameWidthLeft, 0, Height - FrameWidthTop);
      recPL.Add(FrameWidthRight, 0, Height - FrameWidthTop);
      recPL.Add(FrameWidthRight, 0, FrameWidthBottom);
      RecBase = recPL.ToNurbsCurve();
    }
    List<Curve> ResultBase = new List<Curve>();
    {
      Polyline recPL = new Polyline(5);
      recPL.Add(0, 0, 0);
      recPL.Add(Width * CountX, 0, 0);
      recPL.Add(Width * CountX, 0, Height * CountY);
      recPL.Add(0, 0, Height * CountY);
      recPL.Add(0, 0, 0);
      ResultBase.Add(recPL.ToNurbsCurve());
    }

    for(int cntx = 0;cntx < CountX;cntx++){
      for(int cnty = 0;cnty < CountY;cnty++){
        Curve Rec = (Curve) RecBase.Duplicate();
        Rec.Translate(cntx * Width, 0, cnty * Height);
        ResultBase.Add(Rec);
      }
    }
    return Brep.CreatePlanarBreps(ResultBase);
  }
# ---------- end frame2d ----------
crv = Curve([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])  # disabled
c_script = CSharpScript(x=crv)  # -> out, A, B, C; inputs x: Curve; disabled
# ---------- c_script: C# ----------
    try{
      Brep[][] result = GetHandrailGlass(x, 700, 100, 600, 750, 50, 25, 37.5, 10, 100, 5.0);
      A = result[0];
      B = result[1];
      C = result[2];
    }catch(Exception e){
      Print(e.StackTrace);
      Print(e.Message);
    }
# ---------- c_script: C# additional code ----------
  public static Brep[][] GetHandrailGlass(Curve BaseCurve, double Height, double GlassHeightBottom, double GlassHeightTop, double Space, double GlassMarginSide, double Radius1, double Radius2, double GlassThick, double EndSpace, double FrameWidth){
    EndSpace = BaseCurve.IsClosed ? 0 : EndSpace;
    List<Brep> Handrail = new List<Brep>();
    List<Brep> Glass = new List<Brep>();
    List<Brep> Frame = new List<Brep>();
    {
      Curve TopRailCurve = (Curve) BaseCurve.Duplicate();
      TopRailCurve.Translate(0, 0, Height);
      Handrail.Add(Brep.CreateFromSweep(TopRailCurve, GeneralHelper.GetCurveForSweep(NurbsCurve.CreateFromCircle(new Circle(Radius2)), TopRailCurve), true, Space / 1000)[0]);
    }
    double Length = BaseCurve.GetLength();
    double EndTreatment = 0.5;
    for (double CurrentLength = EndSpace; CurrentLength + Space * EndTreatment + EndSpace < Length; CurrentLength += Space)
    {
      Point3d Point1 = BaseCurve.PointAtLength(CurrentLength);
      Point3d Point2 = BaseCurve.PointAtLength(CurrentLength + Space);
      if(CurrentLength + Space * (EndTreatment + 1) > Length){Point2 = BaseCurve.PointAtLength(Length - EndSpace);}

      Handrail.Add(Brep.CreateFromSurface(Surface.CreateExtrusion(NurbsCurve.CreateFromCircle(new Circle(Point1, Radius1)), new Vector3d(0, 0, Height))).CapPlanarHoles(0));

      double GlassLength = (Point2 - Point1).Length;
      if(GlassLength > GlassMarginSide * 2){
        Brep GlassTemp = Brep.CreateFromBox(new Box(Plane.WorldXY, new Interval(GlassMarginSide, GlassLength - GlassMarginSide), new Interval(-GlassThick / 2.0, GlassThick / 2.0), new Interval(GlassHeightBottom, GlassHeightTop)));
        GlassTemp = GeneralHelper.FitTwoPoint(GlassTemp, Point1, Point2);
        Glass.Add(GlassTemp);
        if(FrameWidth > 0){
          {
            Brep FrameTemp = Brep.CreateFromBox(new Box(Plane.WorldXY, new Interval(0, GlassLength), new Interval(-GlassThick / 2.0, GlassThick / 2.0), new Interval(GlassHeightBottom - FrameWidth, GlassHeightBottom)));
            FrameTemp = GeneralHelper.FitTwoPoint(FrameTemp, Point1, Point2);
            Frame.Add(FrameTemp);
          }
          {
            Brep FrameTemp = Brep.CreateFromBox(new Box(Plane.WorldXY, new Interval(0, GlassLength), new Interval(-GlassThick / 2.0, GlassThick / 2.0), new Interval(GlassHeightTop, GlassHeightTop + FrameWidth)));
            FrameTemp = GeneralHelper.FitTwoPoint(FrameTemp, Point1, Point2);
            Frame.Add(FrameTemp);
          }
          {
            Brep FrameTemp = Brep.CreateFromBox(new Box(Plane.WorldXY, new Interval(GlassMarginSide - FrameWidth, GlassMarginSide), new Interval(-GlassThick / 2.0, GlassThick / 2.0), new Interval(GlassHeightBottom, GlassHeightTop)));
            FrameTemp = GeneralHelper.FitTwoPoint(FrameTemp, Point1, Point2);
            Frame.Add(FrameTemp);
          }
          {
            Brep FrameTemp = Brep.CreateFromBox(new Box(Plane.WorldXY, new Interval(GlassLength - GlassMarginSide, GlassLength - GlassMarginSide + FrameWidth), new Interval(-GlassThick / 2.0, GlassThick / 2.0), new Interval(GlassHeightBottom, GlassHeightTop)));
            FrameTemp = GeneralHelper.FitTwoPoint(FrameTemp, Point1, Point2);
            Frame.Add(FrameTemp);
          }
        }
      }
    }
    if (!BaseCurve.IsClosed)
    {
      Handrail.Add(Brep.CreateFromSurface(Surface.CreateExtrusion(NurbsCurve.CreateFromCircle(new Circle(BaseCurve.PointAtLength(Length - EndSpace), Radius1)), new Vector3d(0, 0, Height))).CapPlanarHoles(0));
      Handrail[0] = Handrail[0].CapPlanarHoles(0);
    }
    Brep[][] Result = new Brep[3][];
    Result[0] = Handrail.ToArray();
    Result[1] = Glass.ToArray();
    Result[2] = Frame.ToArray();
    return Result;
  }

  public static class GeneralHelper{

    public static double GetCurvatureAsAngle(Curve cv, double t)
    {
      Vector3d Curvature = cv.TangentAt(t);

      double angle = 0;
      if (Curvature.Y == 0) { angle = Math.PI / 2.0; }
      else
      {
        angle = -Math.Atan(Curvature.X / Curvature.Y);
        if (Curvature.X < 0) { angle += Math.PI; }
      }
      return angle;
    }

    public static Curve GetCurveForSweep(Curve Shape, Curve Rail)
    {
      Rail.Domain = new Interval(0, 1);
      Shape.Rotate(Math.PI / 2.0, new Vector3d(1, 0, 0), new Point3d(0, 0, 0));
      Shape.Rotate(GeneralHelper.GetCurvatureAsAngle(Rail, 0), new Vector3d(0, 0, 1), new Point3d(0, 0, 0));
      Shape.Translate((Vector3d) Rail.PointAtStart);
      return Shape;
    }

    public static Brep FitTwoPoint(Brep Origin, Point3d Point1, Point3d Point2){
      Vector3d Direction = Point2 - Point1;
      Brep Result = (Brep) Origin.Duplicate();
      double Angle;
      if (Direction.X == 0) { Angle = Math.PI / 2.0; }else{
        Angle = Math.Atan(Direction.Y / Direction.X);
        if(Direction.X < 0){Angle += Math.PI;}
      }

      Result.Rotate(Angle, new Vector3d(0, 0, 1), new Point3d(0, 0, 0));
      Result.Translate((Vector3d) Point1);
      return Result;
    }
  }

  public static Brep[] GetHandrailSimple(Curve BaseCurve, double Height, double[] RailHeight, double Space, double Radius1, double Radius2, double Radius3)
  {
    List<Brep> Result = new List<Brep>();
    {
      Curve TopRailCurve = (Curve) BaseCurve.Duplicate();
      TopRailCurve.Translate(0, 0, Height);
      Result.Add(Brep.CreateFromSweep(TopRailCurve, GeneralHelper.GetCurveForSweep(NurbsCurve.CreateFromCircle(new Circle(Radius2)), TopRailCurve), true, Space / 1000)[0]);
    }
    foreach (double TempHeight in RailHeight)
    {
      Curve TopRailCurve = (Curve) BaseCurve.Duplicate();
      TopRailCurve.Translate(0, 0, TempHeight);
      Result.Add(Brep.CreateFromSweep(TopRailCurve, GeneralHelper.GetCurveForSweep(NurbsCurve.CreateFromCircle(new Circle(Radius3)), TopRailCurve), true, Space / 1000)[0]);
    }
    double Length = BaseCurve.GetLength();
    for (double CurrentLength = 0; CurrentLength < Length; CurrentLength += Space)
    {
      Result.Add(Brep.CreateFromSurface(Surface.CreateExtrusion(NurbsCurve.CreateFromCircle(new Circle(BaseCurve.PointAtLength(CurrentLength), Radius1)), new Vector3d(0, 0, Height))).CapPlanarHoles(0));
    }
    if (!BaseCurve.IsClosed)
    {
      Result.Add(Brep.CreateFromSurface(Surface.CreateExtrusion(NurbsCurve.CreateFromCircle(new Circle(BaseCurve.PointAtLength(Length), Radius1)), new Vector3d(0, 0, Height))).CapPlanarHoles(0));
      Result[0] = Result[0].CapPlanarHoles(0);
      for (int i = 0; i < RailHeight.GetLength(0); i++)
      {
        Result[1 + i] = Result[1 + i].CapPlanarHoles(0);
      }
    }

    return Result.ToArray();
  }
# ---------- end c_script ----------
c_script_2 = CSharpScript()  # -> out, A
# ---------- c_script_2: C# ----------
    //A = GetPipeSimple(new double[]{0.0,10.0,30.0}, new double[]{2.0,3.0,1.5});

    //A = GetPipeHead(new double[]{0.0,35.0,40.0}, new double[]{7.0,9.0});
    try{
      GraphObject.Graph human = GraphObject.Graph.GetHumanBody(1600);
      human.MoveRandom();
      A = human.GetBrep();
    }catch(Exception e){
      Print(e.StackTrace);
      Print(e.Message);
    }
# ---------- c_script_2: C# additional code ----------
  public static Brep GetPipeSimple(double[] Distance, double[] Radius){
    return Brep.CreateFromRevSurface(RevSurface.Create(GetHeightMap(Distance, Radius), new Line(0, 0, 0, 1, 0, 0)), false, false);
  }

  public static Brep GetPipeHalf(double[] Distance, double[] Radius){
    Curve RevBase = GetHeightMap(Distance, Radius);
    /*
    Curve Rev2 = (Curve) RevBase.Duplicate();
    Rev2.Rotate(Math.PI, new Vector3d(1, 0, 0), new Point3d(0, 0, 0));
    Rev2 = Curve.JoinCurves(new Curve[]{RevBase,Rev2});
    */
    return Brep.CreateFromRevSurface(RevSurface.Create(RevBase, new Line(0, 0, 0, 1, 0, 0), Math.PI * 0, Math.PI), true, true);
  }

  public static Curve GetHeightMap(double[] Distance, double[] Radius){
    List<Point3d> Points = new List<Point3d>();
    for(int i = 0;i < Distance.GetLength(0);i++){
      Points.Add(new Point3d(Distance[i], Radius[i], 0));
    }
    List<Curve> intcrv = new List<Curve>();
    intcrv.Add(Curve.CreateInterpolatedCurve(Points, 3));
    if(Radius[0] > 0)intcrv.Add((new Line(Distance[0], Radius[0], 0, Distance[0], 0, 0)).ToNurbsCurve());
    if(Radius[Radius.GetLength(0) - 1] > 0)intcrv.Add((new Line(Distance[Distance.GetLength(0) - 1], Radius[Radius.GetLength(0) - 1], 0, Distance[Distance.GetLength(0) - 1], 0, 0)).ToNurbsCurve());
    return Curve.JoinCurves(intcrv)[0];
  }

  public static Brep GetPipeHead(double[] Distance, double[] Radius){
    List<Point3d> Points = new List<Point3d>();
    for(int i = 0;i < Radius.GetLength(0);i++){
      Points.Add(new Point3d(Distance[i], Radius[i], 0));
    }
    Points.Add(new Point3d(Distance[Distance.GetLength(0) - 1], 0, 0));
    for(int i = Radius.GetLength(0) - 1;i >= 0;i--){
      Points.Add(new Point3d(Distance[i], -Radius[i], 0));
    }
    Curve intcrv = Curve.CreateInterpolatedCurve(Points, 3, CurveKnotStyle.Chord);
    intcrv.Domain = new Interval(0, 1);
    intcrv = intcrv.Split(0.5)[0];
    //if(Distance[0] != 0)intcrv = Curve.JoinCurves(new Curve[]{intcrv,(new Line(Distance[0], Radius[0], 0, Distance[0], 0, 0)).ToNurbsCurve()})[0];
    return Brep.CreateFromRevSurface(RevSurface.Create(intcrv, new Line(0, 0, 0, 1, 0, 0), 0, Math.PI * 2.0), true, true);
  }


  public class GraphObject{
    public class Path{
      //public double RotationAngle{get{return _RotationAngle;}set{_RotationAngle = Math.Max(RotationAngleLimitation.Min, Math.Min(RotationAngleLimitation.Max, value % (Math.PI * 2.0)));}}
      //private double _RotationAngle = 0;
      //public Interval RotationAngleLimitation;
      public Brep[] ContentBrep;
      public double Length;

      public static Path CreateFromPipeSimple(double[] Distance, double[] Radius){
        return new Path(){ContentBrep = new Brep[]{GetPipeSimple(Distance, Radius)},Length = Distance[Distance.GetLength(0) - 1] - Distance[0]};
      }

      public static Path CreateFromPipeHead(double[] Distance, double[] Radius){
        return new Path(){ContentBrep = new Brep[]{ GetPipeHead(Distance, Radius)},Length = Distance[Distance.GetLength(0) - 1] - Distance[0]};
      }
    }

    public class Node{
      public Path Target1;
      public Path Target2;
      public Point3d Target1ConnectionPoint = new Point3d(0, 0, 0);
      public Point3d Target2ConnectionPoint = new Point3d(0, 0, 0);
      public double Radius;
      public Brep[] ContentBrep;

      public double RotationAngleX{get{return _RotationAngleX;}set{_RotationAngleX = Math.Max(RotationAngleXLimitation.Min, Math.Min(RotationAngleXLimitation.Max, value % (Math.PI * 2.0)));}}
      private double _RotationAngleX = 0;
      public Interval RotationAngleXLimitation = new Interval(0, Math.PI * 2.0);

      public double RotationAngleY{get{return _RotationAngleY;}set{_RotationAngleY = Math.Max(RotationAngleYLimitation.Min, Math.Min(RotationAngleYLimitation.Max, value % (Math.PI * 2.0)));}}
      private double _RotationAngleY = 0;
      public Interval RotationAngleYLimitation = new Interval(0, Math.PI * 2.0);

      public double RotationAngleZ{get{return _RotationAngleZ;}set{_RotationAngleZ = Math.Max(RotationAngleZLimitation.Min, Math.Min(RotationAngleZLimitation.Max, value % (Math.PI * 2.0)));}}
      private double _RotationAngleZ = 0;
      public Interval RotationAngleZLimitation = new Interval(0, Math.PI * 2.0);

      public Path GetPathOtherThan(Path that){
        if(that == Target1){return Target2;}
        else if(that == Target2){return Target1;}
        else{return new Path();}
      }

      public Point3d GetConnectionPoint(Path that){
        if(that == Target1){return new Point3d(Target1ConnectionPoint);}
        else if(that == Target2){return  new Point3d(Target2ConnectionPoint);}
        else{return new Point3d(0, 0, 0);}
      }

      public static Node CreateFromSphere(double rad, double len){
        return new Node(){Radius = len / 2.0,ContentBrep = new Brep[]{Brep.CreateFromSphere(new Sphere(new Point3d(0, 0, 0), rad))}};
      }
    }

    public class Graph{
      public Path RootPath;//You can set this length to zero to set Node as root.
      private Dictionary<Path,List<Node>> NodesDic = new Dictionary<Path,List<Node>>();
      public Point3d Position;
      public double RotationAngleX = 0;
      public double RotationAngleY = 0;
      public double RotationAngleZ = 0;
      public double AddScale = 1.0;


      public Path[] Paths{get{
          List<Path> Result = new List<Path>();
          Result.Add(RootPath);
          foreach(KeyValuePair<Path,List<Node>> kvp in NodesDic){
            foreach(Node nd in kvp.Value){
              Path pathtoadd = nd.GetPathOtherThan(kvp.Key);
              if(!Result.Contains(pathtoadd))Result.Add(pathtoadd);
            }
          }
          return Result.ToArray();
        }
      }
      public Node[] Nodes{get{
          List<Node> Result = new List<Node>();
          foreach(KeyValuePair<Path,List<Node>> kvp in NodesDic){
            foreach(Node nd in kvp.Value){
              Result.Add(nd);
            }
          }
          return Result.ToArray();
        }
      }

      public Node Add(Path PathToConnect, Path PathToAdd, double rad, double len){
        return Add(PathToConnect, new Point3d(PathToConnect.Length / AddScale, 0, 0), PathToAdd, Node.CreateFromSphere(rad, len));
      }

      public Node Add(Path PathToConnect, Point3d ConnectionPoint, Path PathToAdd, Node node){
        node.Target1 = PathToConnect;
        node.Target1ConnectionPoint = ConnectionPoint * AddScale;
        node.Target2 = PathToAdd;

        Brep[] newbp;
        newbp = new Brep[PathToAdd.ContentBrep.GetLength(0)];
        for(int i = 0;i < PathToAdd.ContentBrep.GetLength(0);i++){
          newbp[i] = (Brep) PathToAdd.ContentBrep[i].Duplicate();
          newbp[i].Scale(AddScale);
        }
        PathToAdd.ContentBrep = newbp;
        PathToAdd.Length *= AddScale;

        newbp = new Brep[PathToConnect.ContentBrep.GetLength(0)];
        for(int i = 0;i < node.ContentBrep.GetLength(0);i++){
          newbp[i] = (Brep) node.ContentBrep[i].Duplicate();
          newbp[i].Scale(AddScale);
        }
        node.ContentBrep = newbp;

        node.Radius *= AddScale;

        NodesDic[PathToConnect].Add(node);
        NodesDic.Add(PathToAdd, new List<Node>());
        return node;
      }

      public void MoveRandom(){
        Random rd = new Random();
        foreach(Node nd in Nodes){
          nd.RotationAngleX = nd.RotationAngleXLimitation.Min + nd.RotationAngleXLimitation.Length * rd.NextDouble();
          nd.RotationAngleY = nd.RotationAngleYLimitation.Min + nd.RotationAngleYLimitation.Length * rd.NextDouble();
          nd.RotationAngleZ = nd.RotationAngleZLimitation.Min + nd.RotationAngleZLimitation.Length * rd.NextDouble();
        }
      }

      public Graph(Path Root, Point3d Position):this(Root, Position, false){
      }

      public Graph(Path Root, Point3d ObjectPosition, bool CanRootMoveFreely):this(Root, ObjectPosition, CanRootMoveFreely, 1.0){
      }

      public Graph(Path Root, Point3d ObjectPosition, bool CanRootMoveFreely, double Scale){
        this.AddScale = Scale;
        this.Position = ObjectPosition * AddScale;

        Brep[] newbp;
        newbp = new Brep[Root.ContentBrep.GetLength(0)];
        for(int i = 0;i < Root.ContentBrep.GetLength(0);i++){
          newbp[i] = (Brep) Root.ContentBrep[i].Duplicate();
          newbp[i].Scale(AddScale);
        }
        Root.ContentBrep = newbp;
        Root.Length *= AddScale;

        if(CanRootMoveFreely){
          RootPath = new Path(){Length = 0};
          NodesDic.Add(RootPath, new List<Node>(){new Node(){Target1 = RootPath,Target2 = Root,Radius = 0,ContentBrep = new Brep[0]}});
        }else{
          RootPath = Root;
          NodesDic.Add(Root, new List<Node>());
        }
      }

      public Brep[] GetBrep(){
        List<Brep[]> ResultPre = GetGraphFromPath(this.RootPath, this.Position, RotationAngleX, RotationAngleY, RotationAngleZ);
        List<Brep> Result = new List<Brep>();
        foreach(Brep[] bps in ResultPre){
          Result.AddRange(bps);
        }
        return Result.ToArray();
      }

      private List<Brep[]> GetGraphFromPath(Path p, Point3d crtpos, double crtangx, double crtangy, double crtangz){
        List<Brep[]> Result = new List<Brep[]>();
        Brep[] TempBreps = new Brep[p.ContentBrep.GetLength(0)];
        int cnt = 0;
        foreach(Brep bp in p.ContentBrep){
          Brep tempbp = (Brep) bp.Duplicate();
          bp.Rotate(crtangy, new Vector3d(0, 1, 0), new Point3d(0, 0, 0));
          bp.Rotate(crtangz, new Vector3d(0, 0, 1), new Point3d(0, 0, 0));
          bp.Translate((Vector3d) crtpos);
          TempBreps[cnt] = bp;
          cnt++;
        }
        Result.Add(TempBreps);
        foreach(Node nd in this.NodesDic[p]){
          Point3d cntpt = nd.GetConnectionPoint(p) + new Point3d(nd.Radius, 0, 0);
          cntpt.Transform(Transform.Rotation(crtangx, new Vector3d(1, 0, 0), new Point3d(0, 0, 0)));
          cntpt.Transform(Transform.Rotation(crtangy, new Vector3d(0, 1, 0), new Point3d(0, 0, 0)));
          cntpt.Transform(Transform.Rotation(crtangz, new Vector3d(0, 0, 1), new Point3d(0, 0, 0)));

          Point3d ndpt = new Point3d(nd.Radius, 0, 0);
          ndpt.Transform(Transform.Rotation(crtangx + nd.RotationAngleX, new Vector3d(1, 0, 0), new Point3d(0, 0, 0)));
          ndpt.Transform(Transform.Rotation(crtangy + nd.RotationAngleY, new Vector3d(0, 1, 0), new Point3d(0, 0, 0)));
          ndpt.Transform(Transform.Rotation(crtangz + nd.RotationAngleZ, new Vector3d(0, 0, 1), new Point3d(0, 0, 0)));

          Brep[] NodeBrep = new Brep[nd.ContentBrep.GetLength(0)];
          for(int i = 0;i < nd.ContentBrep.GetLength(0);i++){
            Brep tbp = (Brep) nd.ContentBrep[i].Duplicate();
            tbp.Translate((Vector3d) (crtpos + cntpt));
            NodeBrep[i] = tbp;
          }
          Result.Add(NodeBrep);

          Result.AddRange(GetGraphFromPath(nd.GetPathOtherThan(p), crtpos + cntpt + ndpt, crtangx + nd.RotationAngleY, crtangy + nd.RotationAngleY, crtangz + nd.RotationAngleZ));
        }
        return Result;
      }

      public static Graph GetHumanBody(double Height){
        Graph Result = new Graph(Path.CreateFromPipeSimple(new double[]{0,15,30}, new double[]{20,20,15}), new Point3d(0, 0, 165), false, Height / 260.0);
        Result.RotationAngleY = -Math.PI / 2.0;
        List<Node> HumanNodes = new List<Node>();

        Path chest = Path.CreateFromPipeSimple(new double[]{0,40,50}, new double[]{15,20,10});
        HumanNodes.Add(Result.Add(Result.RootPath, chest, 15, 15));
        HumanNodes[0].RotationAngleXLimitation = new Interval(-Math.PI / 180.0 * 15, Math.PI / 180.0 * 15);
        HumanNodes[0].RotationAngleYLimitation = new Interval(-Math.PI / 180.0 * 15, Math.PI / 180.0 * 15);
        HumanNodes[0].RotationAngleZLimitation = new Interval(-Math.PI / 180.0 * 15, Math.PI / 180.0 * 15);

        Path head = Path.CreateFromPipeHead(new double[]{0,30,45}, new double[]{12,15});
        HumanNodes.Add(Result.Add(chest, head, 7.5, 7.5));
        HumanNodes[1].RotationAngleXLimitation = new Interval(-Math.PI / 180.0 * 80, Math.PI / 180.0 * 80);
        HumanNodes[1].RotationAngleYLimitation = new Interval(-Math.PI / 180.0 * 15, Math.PI / 180.0 * 15);
        HumanNodes[1].RotationAngleZLimitation = new Interval(-Math.PI / 180.0 * 15, Math.PI / 180.0 * 15);

        Path handR1 = Path.CreateFromPipeSimple(new double[]{0,15,30,45}, new double[]{7.5,9.0,7,6});
        HumanNodes.Add(Result.Add(chest, new Point3d(40, 23, 0), handR1, Node.CreateFromSphere(8, 6)));
        HumanNodes[2].RotationAngleXLimitation = new Interval(-Math.PI / 180.0 * 40, Math.PI / 180.0 * 40);

        Path handR2 = Path.CreateFromPipeSimple(new double[]{0,20,40}, new double[]{7,8.0,7});
        HumanNodes.Add(Result.Add(handR1, handR2, 7.5, 4.0));
        HumanNodes[3].RotationAngleXLimitation = new Interval(-Math.PI / 180.0 * 40, Math.PI / 180.0 * 40);

        Path handR3 = new Path(){ContentBrep = new Brep[]{Brep.CreateFromBox(new Box(Plane.WorldXY, new Interval(0, 20), new Interval(-6, 6), new Interval(-1.5, 1.5)))}};
        HumanNodes.Add(Result.Add(handR2, handR3, 4, 3));
        HumanNodes[4].RotationAngleXLimitation = new Interval(0, 0);
        HumanNodes[4].RotationAngleYLimitation = new Interval(-Math.PI / 180.0 * 45, Math.PI / 180.0 * 45);
        HumanNodes[4].RotationAngleZLimitation = new Interval(-Math.PI / 180.0 * 45, Math.PI / 180.0 * 45);

        Path handL1 = Path.CreateFromPipeSimple(new double[]{0,15,30,45}, new double[]{7.5,9.0,7,6});
        HumanNodes.Add(Result.Add(chest, new Point3d(40, -23, 0), handL1, Node.CreateFromSphere(8, 6)));
        HumanNodes[5].RotationAngleXLimitation = new Interval(-Math.PI / 180.0 * 40, Math.PI / 180.0 * 40);

        Path handL2 = Path.CreateFromPipeSimple(new double[]{0,20,40}, new double[]{7,8.0,7});
        HumanNodes.Add(Result.Add(handL1, handL2, 7.5, 4.0));
        HumanNodes[6].RotationAngleXLimitation = new Interval(-Math.PI / 180.0 * 40, Math.PI / 180.0 * 40);

        Path handL3 = new Path(){ContentBrep = new Brep[]{Brep.CreateFromBox(new Box(Plane.WorldXY, new Interval(0, 20), new Interval(-6, 6), new Interval(-1.5, 1.5)))}};
        HumanNodes.Add(Result.Add(handL2, handL3, 4, 3));
        HumanNodes[7].RotationAngleXLimitation = new Interval(0, 0);
        HumanNodes[7].RotationAngleYLimitation = new Interval(-Math.PI / 180.0 * 45, Math.PI / 180.0 * 45);
        HumanNodes[7].RotationAngleZLimitation = new Interval(-Math.PI / 180.0 * 45, Math.PI / 180.0 * 45);

        Path legR1 = Path.CreateFromPipeSimple(new double[]{0,15,40,60}, new double[]{7.5,10.0,7.5,7.0});
        HumanNodes.Add(Result.Add(Result.RootPath, new Point3d(-1.5, 15, 0), legR1, Node.CreateFromSphere(7.5, 6)));
        HumanNodes[8].RotationAngleXLimitation = new Interval(-Math.PI / 180.0 * 40, Math.PI / 180.0 * 40);
        HumanNodes[8].RotationAngleYLimitation = new Interval(Math.PI * 0.5, Math.PI * 1.5);
        HumanNodes[8].RotationAngleZLimitation = new Interval(0, 0);

        Path legR2 = Path.CreateFromPipeSimple(new double[]{0,15.0,45,65}, new double[]{7.5,8.5,7.5,6.5});
        HumanNodes.Add(Result.Add(legR1, legR2, 6, 5));
        HumanNodes[9].RotationAngleXLimitation = new Interval(0, 0);
        HumanNodes[9].RotationAngleYLimitation = new Interval(-Math.PI, 0);
        HumanNodes[9].RotationAngleZLimitation = new Interval(-Math.PI, 0);

        Brep shoes = GetPipeHalf(new double[]{-10,20,30}, new double[]{9,9,0});
        shoes.Rotate(-Math.PI / 2.0, new Vector3d(0, 1, 0), new Point3d(0, 0, 0));
        shoes.Translate(11, 0, 0);

        Path legR3 = new Path(){ContentBrep = new Brep[]{(Brep) shoes.Duplicate()}};
        HumanNodes.Add(Result.Add(legR2, legR3, 4, 2.5));
        HumanNodes[10].RotationAngleXLimitation = new Interval(0, 0);
        HumanNodes[10].RotationAngleYLimitation = new Interval(-Math.PI / 4.0, Math.PI / 4.0);
        HumanNodes[10].RotationAngleZLimitation = new Interval(-Math.PI / 2.0, Math.PI / 2.0);

        Path legL1 = Path.CreateFromPipeSimple(new double[]{0,15,40,60}, new double[]{7.5,10.0,7.5,7.0});
        HumanNodes.Add(Result.Add(Result.RootPath, new Point3d(-1.5, -15, 0), legL1, Node.CreateFromSphere(7.5, 6)));
        HumanNodes[11].RotationAngleXLimitation = new Interval(-Math.PI / 180.0 * 40, Math.PI / 180.0 * 40);
        HumanNodes[11].RotationAngleYLimitation = new Interval(Math.PI * 0.5, Math.PI * 1.5);
        HumanNodes[11].RotationAngleZLimitation = new Interval(0, 0);

        Path legL2 = Path.CreateFromPipeSimple(new double[]{0,15.0,45,65}, new double[]{7.5,8.5,7.5,6.5});
        HumanNodes.Add(Result.Add(legL1, legL2, 6, 5));
        HumanNodes[12].RotationAngleXLimitation = new Interval(0, 0);
        HumanNodes[12].RotationAngleYLimitation = new Interval(-Math.PI, 0);
        HumanNodes[12].RotationAngleZLimitation = new Interval(-Math.PI, 0);

        Path legL3 = new Path(){ContentBrep = new Brep[]{(Brep) shoes.Duplicate()}};
        HumanNodes.Add(Result.Add(legL2, legL3, 4, 2.5));
        HumanNodes[13].RotationAngleXLimitation = new Interval(0, 0);
        HumanNodes[13].RotationAngleYLimitation = new Interval(-Math.PI / 4.0, Math.PI / 4.0);
        HumanNodes[13].RotationAngleZLimitation = new Interval(-Math.PI / 2.0, Math.PI / 2.0);

        return Result;

      }
    }
  }
# ---------- end c_script_2 ----------
extr = Extrude(Base=frame2d.A, Direction=Y)  # disabled
brep = Brep(c_script.A)  # disabled
brep_2 = Brep(c_script.B)  # disabled
brep_3 = Brep(c_script.C)  # disabled
panel = Panel(c_script_2.out)
