# Grasshopper definition Building2.1_autosave.gh (Grasshopper 0.9.76)

number_slider = Slider(100, range=0..100)  # disabled
Y = UnitY(Factor=number_slider)  # disabled
frame2d = CSharpScript()  # -> out, A, B
# ---------- frame2d: C# ----------
    Brep[] a,b;
    GetGlassWindowLight(200, 200, 1000, 2500, 100, 10, out a, out b);
    A = a;B = b;
# ---------- frame2d: C# additional code ----------
  public static void GetGlassWindowLight(int CountX, int CountY, double Width, double Height, double FrameWidth, double GlassThickness, out Brep[] Glass, out Brep[] Frame){
    {
      Polyline secPL = new Polyline(5);
      secPL.Add(0, 0, 0);
      secPL.Add(Width * CountX, 0, 0);
      secPL.Add(Width * CountX, 0, Height * CountY);
      secPL.Add(0, 0, Height * CountY);
      secPL.Add(0, 0, 0);

      List<Brep> GlassBrep = new List<Brep>();
      Curve secCv = secPL.ToNurbsCurve();
      GlassBrep.AddRange(Brep.CreatePlanarBreps(secCv));
      GlassBrep.Add(Brep.CreateFromSurface(Surface.CreateExtrusion(secCv, new Vector3d(0, GlassThickness, 0))));
      secCv.Translate(0, GlassThickness, 0);
      GlassBrep.AddRange(Brep.CreatePlanarBreps(secCv));
      Glass = Brep.CreateSolid(GlassBrep, GlassThickness / 100.0);
    }
    //ToDo: TanslateBreps -GlassThickness
    Frame = GetFrame2d(CountX, CountY, Width, Height, FrameWidth, FrameWidth, FrameWidth, FrameWidth);
  }

  public static Brep[] GetFrame2d(int CountX, int CountY, double Width, double Height, double FrameWidthTop, double FrameWidthLeft, double FrameWidthRight, double FrameWidthBottom){
    Curve RecBase;
    {
      Polyline recPL = new Polyline(5);
      recPL.Add(FrameWidthRight, 0, FrameWidthBottom);
      recPL.Add(Width - FrameWidthLeft, 0, FrameWidthBottom);
      recPL.Add(Width - FrameWidthLeft, 0, Height - FrameWidthTop);
      recPL.Add(FrameWidthRight, 0, Height - FrameWidthTop);
      recPL.Add(FrameWidthRight, 0, FrameWidthBottom);
      RecBase = recPL.ToNurbsCurve();
    }
    List<Curve> ResultBase = new List<Curve>();
    {
      Polyline recPL = new Polyline(5);
      recPL.Add(0, 0, 0);
      recPL.Add(Width * CountX, 0, 0);
      recPL.Add(Width * CountX, 0, Height * CountY);
      recPL.Add(0, 0, Height * CountY);
      recPL.Add(0, 0, 0);
      ResultBase.Add(recPL.ToNurbsCurve());
    }

    for(int cntx = 0;cntx < CountX;cntx++){
      for(int cnty = 0;cnty < CountY;cnty++){
        Curve Rec = (Curve) RecBase.Duplicate();
        Rec.Translate(cntx * Width, 0, cnty * Height);
        ResultBase.Add(Rec);
      }
    }
    return Brep.CreatePlanarBreps(ResultBase);
  }
# ---------- end frame2d ----------
japaneseroof = CSharpScript()  # -> out, A, B; disabled
# ---------- japaneseroof: C# ----------
    Brep[] a;
    Brep[] b;
    double RoofLen = 100000;
    GetJapaneseRoof(RoofLen, RoofLen + 1000, 1000, 0.3, 100, 500, 50, 50, out a, out b);
    A = a;
    B = b;
# ---------- japaneseroof: C# additional code ----------
  public static void GetJapaneseRoof(double LengthTop, double LengthBottom, double Depth, double Pitch, double Height, double RafterSpace, double RafterWidth, double RafterHeight, out Brep[] Main, out Brep[] Rafter){
    Main = GetJapaneseRoofMain(LengthTop, LengthBottom, Depth, Pitch, Height);
    Rafter = GetJapaneseRoofRafter(LengthTop, LengthBottom, Depth, Pitch, Height, RafterSpace, RafterWidth, RafterHeight);
  }

  public static Brep[] GetJapaneseRoofRafter(double LengthTop, double LengthBottom, double Depth, double Pitch, double Height, double RafterSpace, double RafterWidth, double RafterHeight){
    List<Brep> Lafters = new List<Brep>();
    double RafterSpaceBottom = LengthBottom / Math.Floor(LengthBottom / RafterSpace);
    double RafterSpaceTop = LengthTop / Math.Floor(LengthBottom / RafterSpace);

    Curve SectionBase;
    {
      Polyline SectionPL = new Polyline(5);
      SectionPL.Add(RafterWidth / 2.0, 0, 0);
      SectionPL.Add(RafterWidth / 2.0, 0, -RafterHeight);
      SectionPL.Add(-RafterWidth / 2.0, 0, -RafterHeight);
      SectionPL.Add(-RafterWidth / 2.0, 0, 0);
      SectionPL.Add(RafterWidth / 2.0, 0, 0);

      SectionBase = SectionPL.ToNurbsCurve();
    }

    double CurrentPositonTop = -LengthTop / 2.0 + RafterSpaceTop;
    double CurrentPositonBottom = -LengthBottom / 2.0 + RafterSpaceBottom;
    for(;CurrentPositonBottom <= LengthBottom / 2.0 - RafterSpaceBottom;CurrentPositonBottom += RafterSpaceBottom,CurrentPositonTop += RafterSpaceTop){
      Point3d PointTop = new Point3d(CurrentPositonTop, 0, -Height);
      Point3d PointBottom = new Point3d(CurrentPositonBottom, -Depth, -Depth * Pitch - Height);

      Curve TempCurve1 = (Curve) SectionBase.Duplicate();
      TempCurve1.Translate((Vector3d) PointTop);
      Lafters.Add(Brep.CreateFromSurface(Surface.CreateExtrusion(TempCurve1, PointBottom - PointTop)).CapPlanarHoles(Height / 100.0));
    }
    return Lafters.ToArray();
  }

  public static Brep[] GetJapaneseRoofMain(double LengthTop, double LengthBottom, double Depth, double Pitch, double Height){
    List<Brep> ResultRoof = new List<Brep>();
    Polyline RoofPL = new Polyline(5);
    RoofPL.Add(LengthTop / 2.0, 0, 0);
    RoofPL.Add(LengthBottom / 2.0, -Depth, -Depth * Pitch);
    RoofPL.Add(-LengthBottom / 2.0, -Depth, -Depth * Pitch);
    RoofPL.Add(-LengthTop / 2.0, 0, 0);
    RoofPL.Add(LengthTop / 2.0, 0, 0);

    Curve RoofCurve = RoofPL.ToNurbsCurve();
    Brep RoofPlanar = (Brep.CreatePlanarBreps(RoofCurve))[0];
    ResultRoof.Add(RoofPlanar);
    RoofPlanar = (Brep) RoofPlanar.Duplicate();
    RoofPlanar.Translate(0, 0, -Height);
    ResultRoof.Add(RoofPlanar);

    ResultRoof.Add(Brep.CreateFromSurface(Surface.CreateExtrusion(RoofCurve, new Vector3d(0, 0, -Height))));
    return Brep.CreateSolid(ResultRoof, Height / 100.0);
  }
# ---------- end japaneseroof ----------
extr = Extrude(Base=frame2d.A, Direction=Y)  # disabled
