# Grasshopper definition Road.1_autosave.gh (Grasshopper 0.9.76)

crv = Curve([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])
crv_2 = Curve([<curve referenced from the Rhino model> x3])  # disabled
road = CSharpScript(Origin=crv)  # -> out, A; inputs Origin: list of Curve
# ---------- road: C# ----------
    CurveOutline road = new CurveOutline(Origin[0], 5000);
    A = road.TotalCurve;
# ---------- road: C# additional code ----------
  public class Road{
    public double WidthMain;
    public double WidthSidewalk;
    public Curve CenterCurve;
    private CurveOutline OutlineMain;
    private CurveOutline OutlineSidewalk;
    private string OutlineLastUpdatedStatus;

    private void UpdateOutline(){
      string OutlineStatus = "" + WidthMain + "," + WidthSidewalk + "," + CenterCurve.GetLength();
      if(OutlineStatus != OutlineLastUpdatedStatus){
        OutlineMain = new CurveOutline(CenterCurve, WidthMain);
        OutlineSidewalk = new CurveOutline(CenterCurve, WidthSidewalk);
        OutlineSidewalk.CornerStyle = CurveOutline.CurveOutlineCornerStyle.Round;
      }
      OutlineLastUpdatedStatus = OutlineStatus;
    }
    

  }

  public class CurveOutline{
    public double Width;
    public Curve CenterCurve{get{return _CenterCurve;}set{_CenterCurve = value;SetOffsetCurve();SetEndCurve();}}
    private Curve _CenterCurve;

    public Curve[] OffsetCurve{get{return _OffsetCurve;}}
    private Curve[] _OffsetCurve;

    public Curve[] EndCurve{get{return _EndCurve;}}
    private Curve[] _EndCurve;

    private Curve[] OffsetDetectionCurve;
    private Curve[] EndDetectionCurve;

    public Plane BasePlane = Plane.WorldXY;

    public CurveOutlineCornerStyle CornerStyle = CurveOutlineCornerStyle.Sharp;

    public Curve TotalCurve{get{return (Curve.JoinCurves(new Curve[]{_OffsetCurve[0],_OffsetCurve[1],_EndCurve[0],_EndCurve[1]}))[0];}}

    public enum CurveOutlineCornerStyle{
      Round,Sharp
    }

    public CurveOutline(Curve BaseCurve, double Width){
      this.Width = Width;
      CenterCurve = (Curve) BaseCurve.Duplicate();
    }

    private void SetOffsetCurve(){
      _OffsetCurve = new Curve[2];
      _OffsetCurve[0] = (_CenterCurve.Offset(BasePlane, Width / 2.0, Width / 100.0, CurveOffsetCornerStyle.Smooth))[0];
      _OffsetCurve[1] = (_CenterCurve.Offset(BasePlane, -Width / 2.0, Width / 100.0, CurveOffsetCornerStyle.Smooth))[0];

      _OffsetCurve[0].Domain = new Interval(0, 1);
      _OffsetCurve[1].Domain = new Interval(0, 1);

      OffsetDetectionCurve = new Curve[2];
      OffsetDetectionCurve[0] = (_CenterCurve.Offset(BasePlane, (Width / 2.0) * 0.99, Width / 100.0, CurveOffsetCornerStyle.Smooth))[0];
      OffsetDetectionCurve[1] = (_CenterCurve.Offset(BasePlane, -(Width / 2.0) * 0.99, Width / 100.0, CurveOffsetCornerStyle.Smooth))[0];
    }

    private void SetEndCurve(){
      //call SetOffsetCurve() before you call this.
      _EndCurve = new Curve[2];
      EndDetectionCurve = new Curve[2];
      switch(CornerStyle){
        case CurveOutlineCornerStyle.Round:
          _EndCurve[0] = NurbsCurve.CreateFromArc(new Arc(_OffsetCurve[0].PointAtStart, -_OffsetCurve[0].TangentAt(0.0), _OffsetCurve[1].PointAtStart));
          _EndCurve[1] = NurbsCurve.CreateFromArc(new Arc(_OffsetCurve[0].PointAtEnd, _OffsetCurve[0].TangentAt(1.0), _OffsetCurve[1].PointAtEnd));

          EndDetectionCurve[0] = NurbsCurve.CreateFromArc(new Arc(OffsetDetectionCurve[0].PointAtStart, -OffsetDetectionCurve[0].TangentAt(0.0), OffsetDetectionCurve[1].PointAtStart));
          EndDetectionCurve[1] = NurbsCurve.CreateFromArc(new Arc(OffsetDetectionCurve[0].PointAtEnd, OffsetDetectionCurve[0].TangentAt(1.0), OffsetDetectionCurve[1].PointAtEnd));
          break;
        case CurveOutlineCornerStyle.Sharp:
          _EndCurve[0] = NurbsCurve.CreateFromLine(new Line(_OffsetCurve[0].PointAtStart, _OffsetCurve[1].PointAtStart));
          _EndCurve[1] = NurbsCurve.CreateFromLine(new Line(_OffsetCurve[0].PointAtEnd, _OffsetCurve[1].PointAtEnd));

          EndDetectionCurve[0] = NurbsCurve.CreateFromLine(new Line(OffsetDetectionCurve[0].PointAtStart, OffsetDetectionCurve[1].PointAtStart));
          EndDetectionCurve[1] = NurbsCurve.CreateFromLine(new Line(OffsetDetectionCurve[0].PointAtEnd, OffsetDetectionCurve[1].PointAtEnd));
          break;
      }
    }
  }
# ---------- end road ----------
c_script = CSharpScript(x=crv_2)  # -> out, A; inputs x: list of Curve; disabled
# ---------- c_script: C# ----------
    try{
      A = GetCurveWithWidth(TrimOutline(x.ToArray(), new double[]{10000,5000}), 300);
    }catch(Exception e){
      Print(e.Message);
      Print(e.StackTrace);
    }
# ---------- c_script: C# additional code ----------
  public Curve[] TrimOutline(Curve[] Origin, double[] Width){
    Curve[] OutlineCurve = new Curve[Origin.GetLength(0)];
    List<List<Curve>> Result = new List<List<Curve>>();
    for(int i = 0;i < Origin.GetLength(0);i++){
      OutlineCurve[i] = GetCurveWithWidth(Origin[i], Width[Math.Min(i, Width.GetLength(0) - 1)]);
      Result.Add(new List<Curve>());
      //Result[i].Add((Curve) OutlineCurve[i].Duplicate());
      Result[i].Add((Curve) Origin[i].Duplicate());
    }
    for(int i = 0;i < Origin.GetLength(0);i++){
      for(int j = 0;j < Result.Count();j++){
        if(i == j){continue;}
        for(int k = 0;k < Result[j].Count();k++){
          Curve[] TempRet = TrimCurveByOutline(Result[j][k], OutlineCurve[i]);
          if(TempRet.GetLength(0) > 1){
            Result[j].Remove(Result[j][k]);
            Result[j].AddRange(TempRet);
            k--;
          }
        }
      }
    }
    List<Curve> TotalResult = new List<Curve>();
    for(int j = 0;j < Result.Count();j++){
      TotalResult.AddRange(Result[j]);
    }
    return TotalResult.ToArray();
  }

  public Curve[] TrimCurveByOutline(Curve Origin, Curve Cutter){
    Origin.Domain = new Interval(0, 1);
    Cutter.Domain = new Interval(0, 1);
    Rhino.Geometry.Intersect.CurveIntersections CurveIntersectRet = Rhino.Geometry.Intersect.Intersection.CurveCurve(Origin, Cutter, 1.0, 1.0);
    double[] SumLength = new double[]{0.0,0.0};
    int cnt = 0;
    double LastPara = 0.0;
    for(int i = 0;i < CurveIntersectRet.Count();i++){
      if(CurveIntersectRet[i].ParameterA % 1.0 == 0.0)continue;
      if(CurveIntersectRet[i].IsOverlap)continue;
      SumLength[cnt % 2] += CurveIntersectRet[i].ParameterA - LastPara;
      LastPara = CurveIntersectRet[i].ParameterA;
      cnt++;
    }
    int Choice = SumLength[0] < SumLength[1] ? 1 : 0;
    List<Curve> Result = new List<Curve>();
    cnt = 0;
    LastPara = 0.0;
    for(int i = 0;i < CurveIntersectRet.Count();i++){
      if(CurveIntersectRet[i].ParameterA % 1.0 == 0.0)continue;
      if(CurveIntersectRet[i].IsOverlap)continue;
      if(cnt % 2 == Choice){
        if(LastPara == 0){
          Result.Add((Origin.Split(CurveIntersectRet[i].ParameterA))[0]);
        }else{
          Result.Add((Origin.Split(new double[]{LastPara,CurveIntersectRet[i].ParameterA}))[1]);
        }
      }
      LastPara = CurveIntersectRet[i].ParameterA;
      cnt++;
    }
    if(cnt % 2 == Choice){
      if(LastPara == 0){
        Result.Add((Curve) Origin.Duplicate());
      }else{
        Result.Add((Origin.Split(LastPara))[1]);
      }
    }
    return Result.ToArray();
  }

  public Curve[] GetOutlineSimple(Curve[] Origin, double Width){
    Curve[] OutlineCurveBase = new Curve[Origin.GetLength(0)];
    for(int i = 0;i < Origin.GetLength(0);i++){
      OutlineCurveBase[i] = GetCurveWithWidth(Origin[i], Width);
    }
    return Curve.CreateBooleanUnion(OutlineCurveBase);
  }

  public Curve[] GetOutlineSimple(Curve[] Origin, double[] Width){
    Curve[] OutlineCurveBase = new Curve[Origin.GetLength(0)];
    for(int i = 0;i < Origin.GetLength(0);i++){
      OutlineCurveBase[i] = GetCurveWithWidth(Origin[i], Width[Math.Min(i, Width.GetLength(0) - 1)]);
    }
    return Curve.CreateBooleanUnion(OutlineCurveBase);
  }

  public Curve[] GetCurveWithWidth(Curve[] Origin, double Width){
    Curve[] Result = new Curve[Origin.GetLength(0)];
    for(int i = 0;i < Origin.GetLength(0);i++){
      Result[i] = GetCurveWithWidth(Origin[i], Width);
    }
    return Result;
  }

  public Curve GetCurveWithWidth(Curve Origin, double Width){
    Width /= 2;
    Curve cv1 = (Origin.Offset(Plane.WorldXY, Width, Width / 100.0, Rhino.Geometry.CurveOffsetCornerStyle.Sharp))[0];
    Curve cv2 = (Origin.Offset(Plane.WorldXY, -Width, Width / 100.0, Rhino.Geometry.CurveOffsetCornerStyle.Sharp))[0];

    return (Curve.JoinCurves(new Curve[]{cv1,cv2,NurbsCurve.CreateFromLine(new Line(cv1.PointAtEnd, cv2.PointAtEnd)),NurbsCurve.CreateFromLine(new Line(cv1.PointAtStart, cv2.PointAtStart))}))[0];
  }

  public Curve[] GetCurveWithWidthRound(Curve[] Origin, double Width){
    Curve[] Result = new Curve[Origin.GetLength(0)];
    for(int i = 0;i < Origin.GetLength(0);i++){
      Result[i] = GetCurveWithWidthRound(Origin[i], Width);
    }
    return Result;
  }

  public Curve GetCurveWithWidthRound(Curve Origin, double Width){
    Width /= 2;
    Curve cv1 = (Origin.Offset(Plane.WorldXY, Width, Width / 100.0, Rhino.Geometry.CurveOffsetCornerStyle.Sharp))[0];
    Curve cv2 = (Origin.Offset(Plane.WorldXY, -Width, Width / 100.0, Rhino.Geometry.CurveOffsetCornerStyle.Sharp))[0];
    cv1.Domain = new Interval(0, 1);
    cv2.Domain = new Interval(0, 1);

    return (Curve.JoinCurves(new Curve[]{cv1,cv2,NurbsCurve.CreateFromArc(new Arc(cv1.PointAtEnd, cv1.TangentAt(1.0), cv2.PointAtEnd)),NurbsCurve.CreateFromArc(new Arc(cv1.PointAtStart, cv1.TangentAt(0.0), cv2.PointAtStart))}))[0];
  }


  public Curve[] GetDashedLine(Curve Origin, double SegmentLength){
    int Count = (int) Math.Floor(Origin.GetLength() / SegmentLength / 2.0);
    Curve[] result = new Curve[Count + 1];

    for(int i = 0;i <= Count ;i++){
      Curve TempCurve = (Curve) Origin.Duplicate();
      Point3d a = TempCurve.PointAtLength(i * SegmentLength * 2.0);
      Point3d b = TempCurve.PointAtLength(i * SegmentLength * 2.0 + SegmentLength);
      double at,bt;
      TempCurve.ClosestPoint(a, out at);
      TempCurve.ClosestPoint(b, out bt);
      TempCurve = (TempCurve.Split(new double[]{at,bt}))[i == 0 ? 0 : 1];
      result[i] = TempCurve;
    }
    return result;
  }
# ---------- end c_script ----------
c_script_2 = CSharpScript(x=crv_2)  # -> out, A; inputs x: list of Curve; disabled
# ---------- c_script_2: C# ----------
    try{
      A = GetOutlineSimple(x.ToArray(), new double[]{10000,5000});
    }catch(Exception e){
      Print(e.Message);
      Print(e.StackTrace);
    }
# ---------- c_script_2: C# additional code ----------
  public Curve[] TrimOutline(Curve[] Origin, double[] Width){
    Curve[] OutlineCurve = new Curve[Origin.GetLength(0)];
    List<List<Curve>> Result = new List<List<Curve>>();
    for(int i = 0;i < Origin.GetLength(0);i++){
      OutlineCurve[i] = GetCurveWithWidth(Origin[i], Width[Math.Min(i, Width.GetLength(0) - 1)]);
      Result.Add(new List<Curve>());
      //Result[i].Add((Curve) OutlineCurve[i].Duplicate());
      Result[i].Add((Curve) Origin[i].Duplicate());
    }
    for(int i = 0;i < Origin.GetLength(0);i++){
      for(int j = 0;j < Result.Count();j++){
        if(i == j){continue;}
        for(int k = 0;k < Result[j].Count();k++){
          Curve[] TempRet = TrimCurveByOutline(Result[j][k], OutlineCurve[i]);
          MessageBox.Show("GL" + TempRet.GetLength(0));
          if(TempRet.GetLength(0) > 1){
            Result[j].Remove(Result[j][k]);
            Result[j].AddRange(TempRet);
            k--;
          }
        }
      }
    }
    List<Curve> TotalResult = new List<Curve>();
    for(int j = 0;j < Result.Count();j++){
      TotalResult.AddRange(Result[j]);
    }
    return TotalResult.ToArray();
  }

  public Curve[] TrimCurveByOutline(Curve Origin, Curve Cutter){
    Origin.Domain = new Interval(0, 1);
    Cutter.Domain = new Interval(0, 1);
    Rhino.Geometry.Intersect.CurveIntersections CurveIntersectRet = Rhino.Geometry.Intersect.Intersection.CurveCurve(Origin, Cutter, 1.0, 1.0);
    double[] SumLength = new double[]{0.0,0.0};
    int cnt = 0;
    double LastPara = 0.0;
    for(int i = 0;i < CurveIntersectRet.Count();i++){
      if(CurveIntersectRet[i].ParameterA % 1.0 == 0.0)continue;
      if(CurveIntersectRet[i].IsOverlap)continue;
      SumLength[cnt % 2] += CurveIntersectRet[i].ParameterA - LastPara;
      LastPara = CurveIntersectRet[i].ParameterA;
      cnt++;
    }
    int Choice = SumLength[0] < SumLength[1] ? 1 : 0;
    List<Curve> Result = new List<Curve>();
    cnt = 0;
    LastPara = 0.0;
    for(int i = 0;i < CurveIntersectRet.Count();i++){
      if(CurveIntersectRet[i].ParameterA % 1.0 == 0.0)continue;
      if(CurveIntersectRet[i].IsOverlap)continue;
      if(cnt % 2 == Choice){
        if(LastPara == 0){
          MessageBox.Show("Para" + CurveIntersectRet[i].ParameterA);
          Result.Add((Origin.Split(CurveIntersectRet[i].ParameterA))[0]);
        }else{
          Result.Add((Origin.Split(new double[]{LastPara,CurveIntersectRet[i].ParameterA}))[1]);
        }
      }
      LastPara = CurveIntersectRet[i].ParameterA;
      cnt++;
    }
    if(cnt % 2 == Choice){
      if(LastPara == 0){
        Result.Add((Curve) Origin.Duplicate());
      }else{
        Result.Add((Origin.Split(LastPara))[1]);
      }
    }
    return Result.ToArray();
  }

  public Curve[] GetOutlineSimple(Curve[] Origin, double Width){
    Curve[] OutlineCurveBase = new Curve[Origin.GetLength(0)];
    for(int i = 0;i < Origin.GetLength(0);i++){
      OutlineCurveBase[i] = GetCurveWithWidth(Origin[i], Width);
    }
    return Curve.CreateBooleanUnion(OutlineCurveBase);
  }

  public Curve[] GetOutlineSimple(Curve[] Origin, double[] Width){
    Curve[] OutlineCurveBase = new Curve[Origin.GetLength(0)];
    for(int i = 0;i < Origin.GetLength(0);i++){
      OutlineCurveBase[i] = GetCurveWithWidthRound(Origin[i], Width[Math.Min(i, Width.GetLength(0) - 1)]);
    }
    return Curve.CreateBooleanUnion(OutlineCurveBase);
  }

  public Curve[] GetCurveWithWidth(Curve[] Origin, double Width){
    Curve[] Result = new Curve[Origin.GetLength(0)];
    for(int i = 0;i < Origin.GetLength(0);i++){
      Result[i] = GetCurveWithWidth(Origin[i], Width);
    }
    return Result;
  }

  public Curve GetCurveWithWidth(Curve Origin, double Width){
    Width /= 2;
    Curve cv1 = (Origin.Offset(Plane.WorldXY, Width, Width / 100.0, Rhino.Geometry.CurveOffsetCornerStyle.Sharp))[0];
    Curve cv2 = (Origin.Offset(Plane.WorldXY, -Width, Width / 100.0, Rhino.Geometry.CurveOffsetCornerStyle.Sharp))[0];

    return (Curve.JoinCurves(new Curve[]{cv1,cv2,NurbsCurve.CreateFromLine(new Line(cv1.PointAtEnd, cv2.PointAtEnd)),NurbsCurve.CreateFromLine(new Line(cv1.PointAtStart, cv2.PointAtStart))}))[0];
  }

  public Curve[] GetCurveWithWidthRound(Curve[] Origin, double Width){
    Curve[] Result = new Curve[Origin.GetLength(0)];
    for(int i = 0;i < Origin.GetLength(0);i++){
      Result[i] = GetCurveWithWidthRound(Origin[i], Width);
    }
    return Result;
  }

  public Curve GetCurveWithWidthRound(Curve Origin, double Width){
    Width /= 2;
    Curve cv1 = (Origin.Offset(Plane.WorldXY, Width, Width / 100.0, Rhino.Geometry.CurveOffsetCornerStyle.Sharp))[0];
    Curve cv2 = (Origin.Offset(Plane.WorldXY, -Width, Width / 100.0, Rhino.Geometry.CurveOffsetCornerStyle.Sharp))[0];
    cv1.Domain = new Interval(0, 1);
    cv2.Domain = new Interval(0, 1);

    return (Curve.JoinCurves(new Curve[]{cv1,cv2,NurbsCurve.CreateFromArc(new Arc(cv1.PointAtEnd, cv1.TangentAt(1.0), cv2.PointAtEnd)),NurbsCurve.CreateFromArc(new Arc(cv1.PointAtStart, -cv1.TangentAt(0.0), cv2.PointAtStart))}))[0];
  }


  public Curve[] GetDashedLine(Curve Origin, double SegmentLength){
    int Count = (int) Math.Floor(Origin.GetLength() / SegmentLength / 2.0);
    Curve[] result = new Curve[Count + 1];

    for(int i = 0;i <= Count ;i++){
      Curve TempCurve = (Curve) Origin.Duplicate();
      Point3d a = TempCurve.PointAtLength(i * SegmentLength * 2.0);
      Point3d b = TempCurve.PointAtLength(i * SegmentLength * 2.0 + SegmentLength);
      double at,bt;
      TempCurve.ClosestPoint(a, out at);
      TempCurve.ClosestPoint(b, out bt);
      TempCurve = (TempCurve.Split(new double[]{at,bt}))[i == 0 ? 0 : 1];
      result[i] = TempCurve;
    }
    return result;
  }
# ---------- end c_script_2 ----------
c_script_3 = CSharpScript(x=crv_2)  # -> out, A; inputs x: list of Curve; disabled
# ---------- c_script_3: C# ----------
    try{
      A = GetOutlineSimple(x.ToArray(), new double[]{10000,5000});
    }catch(Exception e){
      Print(e.Message);
      Print(e.StackTrace);
    }
# ---------- c_script_3: C# additional code ----------
  public Curve[] TrimOutline(Curve[] Origin, double[] Width){
    Curve[] OutlineCurve = new Curve[Origin.GetLength(0)];
    List<List<Curve>> Result = new List<List<Curve>>();
    for(int i = 0;i < Origin.GetLength(0);i++){
      OutlineCurve[i] = GetCurveWithWidth(Origin[i], Width[Math.Min(i, Width.GetLength(0) - 1)]);
      Result.Add(new List<Curve>());
      //Result[i].Add((Curve) OutlineCurve[i].Duplicate());
      Result[i].Add((Curve) Origin[i].Duplicate());
    }
    for(int i = 0;i < Origin.GetLength(0);i++){
      for(int j = 0;j < Result.Count();j++){
        if(i == j){continue;}
        for(int k = 0;k < Result[j].Count();k++){
          Curve[] TempRet = TrimCurveByOutline(Result[j][k], OutlineCurve[i]);
          MessageBox.Show("GL" + TempRet.GetLength(0));
          if(TempRet.GetLength(0) > 1){
            Result[j].Remove(Result[j][k]);
            Result[j].AddRange(TempRet);
            k--;
          }
        }
      }
    }
    List<Curve> TotalResult = new List<Curve>();
    for(int j = 0;j < Result.Count();j++){
      TotalResult.AddRange(Result[j]);
    }
    return TotalResult.ToArray();
  }

  public Curve[] TrimCurveByOutline(Curve Origin, Curve Cutter){
    Origin.Domain = new Interval(0, 1);
    Cutter.Domain = new Interval(0, 1);
    Rhino.Geometry.Intersect.CurveIntersections CurveIntersectRet = Rhino.Geometry.Intersect.Intersection.CurveCurve(Origin, Cutter, 1.0, 1.0);
    double[] SumLength = new double[]{0.0,0.0};
    int cnt = 0;
    double LastPara = 0.0;
    for(int i = 0;i < CurveIntersectRet.Count();i++){
      if(CurveIntersectRet[i].ParameterA % 1.0 == 0.0)continue;
      if(CurveIntersectRet[i].IsOverlap)continue;
      SumLength[cnt % 2] += CurveIntersectRet[i].ParameterA - LastPara;
      LastPara = CurveIntersectRet[i].ParameterA;
      cnt++;
    }
    int Choice = SumLength[0] < SumLength[1] ? 1 : 0;
    List<Curve> Result = new List<Curve>();
    cnt = 0;
    LastPara = 0.0;
    for(int i = 0;i < CurveIntersectRet.Count();i++){
      if(CurveIntersectRet[i].ParameterA % 1.0 == 0.0)continue;
      if(CurveIntersectRet[i].IsOverlap)continue;
      if(cnt % 2 == Choice){
        if(LastPara == 0){
          MessageBox.Show("Para" + CurveIntersectRet[i].ParameterA);
          Result.Add((Origin.Split(CurveIntersectRet[i].ParameterA))[0]);
        }else{
          Result.Add((Origin.Split(new double[]{LastPara,CurveIntersectRet[i].ParameterA}))[1]);
        }
      }
      LastPara = CurveIntersectRet[i].ParameterA;
      cnt++;
    }
    if(cnt % 2 == Choice){
      if(LastPara == 0){
        Result.Add((Curve) Origin.Duplicate());
      }else{
        Result.Add((Origin.Split(LastPara))[1]);
      }
    }
    return Result.ToArray();
  }

  public Curve[] GetOutlineSimple(Curve[] Origin, double Width){
    Curve[] OutlineCurveBase = new Curve[Origin.GetLength(0)];
    for(int i = 0;i < Origin.GetLength(0);i++){
      OutlineCurveBase[i] = GetCurveWithWidth(Origin[i], Width);
    }
    return Curve.CreateBooleanUnion(OutlineCurveBase);
  }

  public Curve[] GetOutlineSimple(Curve[] Origin, double[] Width){
    Curve[] OutlineCurveBase = new Curve[Origin.GetLength(0)];
    for(int i = 0;i < Origin.GetLength(0);i++){
      OutlineCurveBase[i] = GetCurveWithWidth(Origin[i], Width[Math.Min(i, Width.GetLength(0) - 1)]);
    }
    return Curve.CreateBooleanUnion(OutlineCurveBase);
  }

  public Curve GetCurveWithWidth(Curve Origin, double Width){
    Width /= 2;
    Curve cv1 = (Origin.Offset(Plane.WorldXY, Width, Width / 100.0, Rhino.Geometry.CurveOffsetCornerStyle.Sharp))[0];
    Curve cv2 = (Origin.Offset(Plane.WorldXY, -Width, Width / 100.0, Rhino.Geometry.CurveOffsetCornerStyle.Sharp))[0];

    return (Curve.JoinCurves(new Curve[]{cv1,cv2,NurbsCurve.CreateFromLine(new Line(cv1.PointAtEnd, cv2.PointAtEnd)),NurbsCurve.CreateFromLine(new Line(cv1.PointAtStart, cv2.PointAtStart))}))[0];
  }

  public Curve[] GetDashedLine(Curve Origin, double SegmentLength){
    int Count = (int) Math.Floor(Origin.GetLength() / SegmentLength / 2.0);
    Curve[] result = new Curve[Count + 1];

    for(int i = 0;i <= Count ;i++){
      Curve TempCurve = (Curve) Origin.Duplicate();
      Point3d a = TempCurve.PointAtLength(i * SegmentLength * 2.0);
      Point3d b = TempCurve.PointAtLength(i * SegmentLength * 2.0 + SegmentLength);
      double at,bt;
      TempCurve.ClosestPoint(a, out at);
      TempCurve.ClosestPoint(b, out bt);
      TempCurve = (TempCurve.Split(new double[]{at,bt}))[i == 0 ? 0 : 1];
      result[i] = TempCurve;
    }
    return result;
  }
# ---------- end c_script_3 ----------
crv_3 = Curve(c_script.A)  # disabled
panel = Panel(c_script.out)  # disabled
